# Grasshopper definition 251020_MOCAP_Realsense_Grasshopper.gh (Grasshopper 1.0.8)
# plug-ins: Robot Components, RADiiCapture, Tracker, Telepathy

brep = Brep([<brep referenced from the Rhino model> x4])
panel = Panel("C:\Users\dfabadmin\Desktop\Diderot_data\plaster_stroke_parser-20260521T170611Z-3-001\plaster_stroke_parser\poses_only\plaster_novice_002__mocap_tracker.csv")

# ---- group: parse canvas height from select snippets
curve = Curve([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])
explode = Explode(Curve=curve, Recursive=True)  # -> Segments, flatten(Vertices)
deconstruct = Deconstruct(Point=explode.Vertices)  # -> XComponent, YComponent, ZComponent
sort_list = SortList(Keys=deconstruct.ZComponent)  # -> Keys, ValuesA
list_item = ListItem(List=sort_list.Keys, Index="-1", Wrap=True)
canvas_z = RemoteSender(list_item)

# ---- group: input
# Optitrack Motive <> Rhino Grasshopper Workflow
# CMU Architecture Robotics Lab
# 
# Template by Chloe Xu, 10.02.25.
# 1. Preparation
# Software: Optitrack Motive 3.3
# https://optitrack.com/software/motive/
# 
# Requires Motive physical license (accessible
# from lab computer)
# Requires connection to mocap cameras
# 
# Before recording, after setting up markers in
# physical space, select all relevant markers
# and join them into a rigid body.
# Workflow 1: Record mocap data in Motive
# and import to Grasshopper
# 2. Record Data in Motive
# Record motion in Motive
# 
# Export completed recording as CSV
# 
# *Note: currently there may be an issue with
# exporting data to other file paths, you can
# export to the default folder then move the file.
# 3. Import CSV in Grasshopper
# Set the import file path to your CSV, receive
# planes for recorded rigid bodies.
csv_path = FilePath("C:\Users\HFinchPC\Downloads\Take 2025-09-26 04.17.55 PM.csv")  # disabled

# ----
# Realsense Depth camera <> Rhino Grasshopper Workflow
# To do:
# Run both image and depth captures in realsense sdk (remove RADII usage, but offer as a backup)
# 
# provide recording template to synchronize MOCAP and depth camera in the same clock (with proper time-stamp)
# 
# 
# provide camera coordinate/plane <> MOCAP <> robot calibration procedures using fudcial markers
motive_csv_parser = Python3Script(CSVPath=csv_path)  # -> out, planes; inputs CSVPath: String; disabled
# ---------- motive_csv_parser: Python ----------
#requirements: pandas

## A single purpose script to parse motive tracker version 3.3 csv export data.
## Rigid bodies represented as GH planes using Rhino Script Syntax.
## Note, script currently only works for a single rigid body.
## Josh Bard, Carnegie Mellon University 01.20.17 (ver 1.5 Motive)
## Modified by Chloe Xu, Carnegie Mellon University 10.02.25 (ver 3.3 Motive)
    
    # CSV Parsing: Rigid Body location and orientation found in "frames" rows
    # labels span rows 2-7, including
    # Type (Rigid Body / Rigid Body Marker / Marker) (this script considers only rb)
    # Name (as defined in Motive)
    # ID (GUID as assigned by Motive)
    # Parent (if Rigid Body Marker)
    # Rotation / Position (whether the variable denotes rb rotation or position)
    # Specific Data Labels (which coordinate does the column represent)

    # Per rb plane, the following information is recorded
    # Position: xPosition, yPosition, zPosition
    # Orientation: axis of rotation (rx, ry, rz), 
    #              radians of rotation (rw)

## Modification Note (10.01.25):
## Since previous version, organization of variables in the csv have changed,
## most notably, method or rotation calculation is different. Original method
## employed yaw-pitch-roll style and has since been changed by Motive to quaternion.

## Current version also supports parsing of more than one rigid body, 
    ################################################################
    ################################################################

import math
import pandas as pd
import rhinoscriptsyntax as rs


def plane_from_quat(x, y, z, qx, qy, qz, qw):
    n = math.sqrt(qx*qx + qy*qy + qz*qz + qw*qw)
    if n == 0:
        return rs.MovePlane(rs.WorldXYPlane(), (x, y, z))
    xq, yq, zq, wq = qx/n, qy/n, qz/n, qw/n
    r00 = 1 - 2*(yq*yq + zq*zq); r01 = 2*(xq*yq - zq*wq); r02 = 2*(xq*zq + yq*wq)
    r10 = 2*(xq*yq + zq*wq);     r11 = 1 - 2*(xq*xq + zq*zq); r12 = 2*(yq*zq - xq*wq)
    r20 = 2*(xq*zq - yq*wq);     r21 = 2*(yq*zq + xq*wq);     r22 = 1 - 2*(xq*xq + yq*yq)

    def rot(v):
        vx, vy, vz = v
        return (r00*vx + r01*vy + r02*vz,
                r10*vx + r11*vy + r12*vz,
                r20*vx + r21*vy + r22*vz)

    origin = (x, y, z)
    xaxis  = rot((1.0, 0.0, 0.0))
    yaxis  = rot((0.0, 1.0, 0.0))
    return rs.PlaneFromFrame(origin, xaxis, yaxis)


def mocap_planes_to_branches(csv_path, mm_to_model=1.0):
    """
    Returns (names, branches)
      names:   list of rigid-body names (sorted)
      branches: list of lists of Rhino planes (one branch per rigid body)
    """
    df = pd.read_csv(csv_path, header=None, skiprows = 2)
    # find the 'Frame, Time (Seconds)' header row
    frame_row = df.index[df.iloc[:,0].astype(str) == 'Frame'][0]

    # the 5 rows above define column meta:
    # Type, Name, ID, Parent, Field(Rotation/Position), then component row (X/Y/Z/W)
    type_row  = df.iloc[frame_row-5].fillna('')
    name_row  = df.iloc[frame_row-4].fillna('')
    field_row = df.iloc[frame_row-1].fillna('')
    comp_row  = df.iloc[frame_row  ].fillna('')

    data = df.iloc[frame_row+1:].reset_index(drop=True)

    # mask rigid-body columns
    is_rb = (type_row == 'Rigid Body') & (name_row != '') # ignore markers

    rb_names = name_row[is_rb]
    bodies = sorted(rb_names.unique())

    branches = []
    for nm in bodies:
        # columns that belong to this rigid body
        cols_nm = (name_row == nm)

        # find the indices for Position {X,Y,Z} and Rotation {X,Y,Z,W}
        pos_idx = {label: idx for idx, label in comp_row[(cols_nm) & (field_row=='Position') & (comp_row.isin(['X','Y','Z']))].items()}
        rot_idx = {label: idx for idx, label in comp_row[(cols_nm) & (field_row=='Rotation') & (comp_row.isin(['X','Y','Z','W']))].items()}


        # must have all required components
        if not ({'X','Y','Z'} <= set(pos_idx) and {'X','Y','Z','W'} <= set(rot_idx)):
            continue

        # extract numeric arrays
        px = pd.to_numeric(data.iloc[:, pos_idx['X']], errors='coerce') * mm_to_model
        py = pd.to_numeric(data.iloc[:, pos_idx['Y']], errors='coerce') * mm_to_model
        pz = pd.to_numeric(data.iloc[:, pos_idx['Z']], errors='coerce') * mm_to_model
        qx = pd.to_numeric(data.iloc[:, rot_idx['X']], errors='coerce')
        qy = pd.to_numeric(data.iloc[:, rot_idx['Y']], errors='coerce')
        qz = pd.to_numeric(data.iloc[:, rot_idx['Z']], errors='coerce')
        qw = pd.to_numeric(data.iloc[:, rot_idx['W']], errors='coerce')

        # build planes per frame (skip rows with NaNs)
        planes = []
        for X,Y,Z,QX,QY,QZ,QW in zip(px,py,pz,qx,qy,qz,qw):
            if pd.isna(X) or pd.isna(Y) or pd.isna(Z) or pd.isna(QX) or pd.isna(QY) or pd.isna(QZ) or pd.isna(QW):
                continue
            planes.append(plane_from_quat(float(X), float(Y), float(Z),
                                          float(QX), float(QY), float(QZ), float(QW)))
        branches.append(planes)

    return bodies, branches


def to_datatree(branches):
    try:
        from ghpythonlib import treehelpers as th
        return th.list_to_tree(branches)
    except ImportError:
        return branches


names, branches = mocap_planes_to_branches(CSVPath, mm_to_model=1.0)  # 1.0 if your Rhino units are mm; 0.001 if meters
planes = to_datatree(branches)
# ---------- end motive_csv_parser ----------
trowel_z = RemoteSender(Slider(0, range=-0.1..0.1))
trowel_z_2 = RemoteReceiver(trowel_z)
unit_z = UnitZ(Factor=trowel_z_2)
move = Move(Geometry=brep, Motion=unit_z)  # -> Geometry, Transform
python_3_script = Python3Script(csv_path=panel, swap_yz="1")  # -> out, planes; inputs csv_path: String, swap_yz: Boolean; disabled
# ---------- python_3_script: Python ----------
# GhPython: CSV -> [Plane] with optional Y<->Z swap
# Inputs:
#   csv_path: str
#   swap_yz:  bool
# Outputs:
#   Planes: list[Rhino.Geometry.Plane]
#   Times:  list[float]

import os, math, csv
import Rhino.Geometry as rg

def quat_to_mat3(qx, qy, qz, qw):
    n = math.sqrt(qw*qw + qx*qx + qy*qy + qz*qz)
    if n == 0.0: qw,qx,qy,qz = 1.0,0.0,0.0,0.0
    else: qw,qx,qy,qz = qw/n, qx/n, qy/n, qz/n
    xx,yy,zz = qx*qx, qy*qy, qz*qz
    xy,xz,yz = qx*qy, qx*qz, qy*qz
    wx,wy,wz = qw*qx, qw*qy, qw*qz
    m00 = 1 - 2*(yy + zz); m01 = 2*(xy - wz);   m02 = 2*(xz + wy)
    m10 = 2*(xy + wz);     m11 = 1 - 2*(xx + zz); m12 = 2*(yz - wx)
    m20 = 2*(xz - wy);     m21 = 2*(yz + wx);   m22 = 1 - 2*(xx + yy)
    return ((m00,m01,m02),(m10,m11,m12),(m20,m21,m22))

def mat_mul(A, B):
    return tuple(tuple(sum(A[i][k]*B[k][j] for k in range(3)) for j in range(3)) for i in range(3))

def mat_T(A):
    return ((A[0][0],A[1][0],A[2][0]),
            (A[0][1],A[1][1],A[2][1]),
            (A[0][2],A[1][2],A[2][2]))

def mat3_to_plane(origin, M):
    x = rg.Vector3d(M[0][0], M[0][1], M[0][2])
    y = rg.Vector3d(M[1][0], M[1][1], M[1][2])
    if x.IsZero or y.IsZero:
        return rg.Plane(origin, rg.Vector3d.XAxis, rg.Vector3d.YAxis)
    x.Unitize(); y.Unitize()
    return rg.Plane(origin, x, y)

if not csv_path or not os.path.exists(csv_path):
    raise ValueError("CSV path missing or not found.")

# Permutation for Y<->Z swap
P = ((1,0,0),(0,0,1),(0,1,0)) if swap_yz else ((1,0,0),(0,1,0),(0,0,1))

planes, times = [], []

# Read CSV (expects columns: t, px, py, pz, qx, qy, qz, qw; header optional)
with open(csv_path, 'rb') as fb:
    raw = fb.read()
text = None
for enc in ('utf-8-sig','utf-8'):
    try: text = raw.decode(enc); break
    except: pass
if text is None:
    raise ValueError("Unable to decode CSV as UTF-8/UTF-8-SIG.")

reader = csv.reader(text.splitlines())
header_checked = False

for row in reader:
    if not row: continue
    if not header_checked:
        header_checked = True
        try: float(row[0]); float(row[1])
        except: continue  # skip header
    row = (row + ['']*8)[:8]
    t, px, py, pz, qx, qy, qz, qw = [float(x) for x in row]

    # position: p' = P * p
    p = (px, py, pz)
    p_adj = (
        P[0][0]*p[0] + P[0][1]*p[1] + P[0][2]*p[2],
        P[1][0]*p[0] + P[1][1]*p[1] + P[1][2]*p[2],
        P[2][0]*p[0] + P[2][1]*p[1] + P[2][2]*p[2],
    )
    origin = rg.Point3d(p_adj[0], p_adj[1], p_adj[2])

    # orientation: R' = P * R * P^T
    R = quat_to_mat3(qx, qy, qz, qw)
    R_adj = mat_mul(mat_mul(P, R), mat_T(P))

    plane = mat3_to_plane(origin, R_adj)
    planes.append(plane)
    times.append(t)
# ---------- end python_3_script ----------
trowel = RemoteSender(move.Geometry)

# ---- group: output
# Workflow 2: Stream data from Motive
# to Grasshopper
# 2. Install Streaming Plugin
# Software: Optitrack-gh
# https://github.com/rhughes42/optitrack-
# gh/releases
# 
# 1. Open "Special Components" folder from
# Grasshopper "File" tab
# 2. Download plugin release form Github
# 3. Drag ZIP file into "Special Components" folder
# 4. Right click on ZIP file and select "Unblock",
# then "Apply"
# 5. Unzip ZIP file in the folder
# 6. Delete ZIP file
# 7. Restart Rhino
# 3. Setup Base Geometry
# 1. If applicable, set geometry that you want
# to be moved / rotated along with tracked
# rigid bodies.
# 2. Set up base reference plane of the
# geometry.
# 3. Transformations will be preformed on the
# object by translating your base plane to the
# output planes in Motive.
# 4. Setup Streaming from Motive
# 1. In Motive, streaming settings are at the
# bottom right of the window (double click
# broadcast icon)
# 2. Before activating streaming, ensure settings
# are configured to "Multitrack" and the local
# interface is "Loopback"
# 3. Start Streaming
# 4. In this template, right click the OptiTrack
# Stream component and check "Rigid Body"
# 5. Activate the OptiTrack Stream component
rb_planes = Plane(motive_csv_parser.planes)  # disabled

# ---- group: parse table height
list_item_2 = ListItem(List=python_3_script.planes, Index=0, Wrap=True)
deconstruct_plane = DeconstructPlane(Plane=list_item_2)  # -> Origin, XAxis, YAxis, ZAxis
deconstruct_2 = Deconstruct(Point=deconstruct_plane.Origin)  # -> XComponent, YComponent, ZComponent
negative = Negative(Value=deconstruct_2.ZComponent)
unit_z_2 = UnitZ(Factor=negative)

# ----
canvas_z_2 = RemoteReceiver(canvas_z)
move_2 = Move(Geometry=python_3_script.planes, Motion=unit_z_2)  # -> Geometry, Transform
table_z = RemoteReceiver()
list_length = ListLength(List=move_2.Geometry)
deconstruct_plane_2 = DeconstructPlane(Plane=move_2.Geometry)  # -> Origin, XAxis, YAxis, ZAxis
multiplication = Multiplication(A=list_length, B=Slider(1, range=0..1))

# ---- group: Geometry Setup
tracked_objects = Geometry(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)
origin_point = Point(Point(0, 0, 0))
origin_x = Vector(Vector(1, 0, 0))
origin_y = Vector(Vector(0, 1, 0))
construct_plane = ConstructPlane(Origin=origin_point, XAxis=origin_x, YAxis=origin_y)
origin_plane = Geometry(construct_plane)

# ----
round = Round(Number=multiplication)  # -> Nearest, Floor, Ceiling
polyline = PolyLine(Vertices=deconstruct_plane_2.Origin, Closed=False)

# ---- group: Stream Connector
optitrack_stream = OptiTrackStream(Activate=Toggle(False), Reset=Button(), LocalIP="127.0.0.1", ServerIP="127.0.0.1")  # -> Status, Markers, Labels, RBName, BRPlane

# ----
list_item_3 = ListItem(List=move_2.Geometry, Index=round.Floor, Wrap=True)
curve_2 = Curve(polyline)
tracked_objects_2 = RemoteSender(tracked_objects)
tracked_objects_3 = RemoteReceiver(tracked_objects_2)
origin_plane_2 = RemoteSender(origin_plane)
origin_plane_3 = RemoteReceiver(origin_plane_2)
create_set = CreateSet(List=optitrack_stream.RBName)  # -> Set, Map
deconstruct_plane_3 = DeconstructPlane(Plane=list_item_3)  # -> Origin, XAxis, YAxis, ZAxis
trowel_2 = RemoteReceiver(trowel)
orient = Orient(Geometry=trowel_2, Source=PlaneXY(0, 0, 0), Target=list_item_3)  # -> Geometry, Transform
deconstruct_3 = Deconstruct(Point=deconstruct_plane_3.Origin)  # -> XComponent, YComponent, ZComponent
list_item_4 = ListItem(List=optitrack_stream.BRPlane, Index=create_set.Map, Wrap=True)
geometry = Geometry(orient.Geometry)
panel_2 = Panel(optitrack_stream.Status)
tracked_planes = RemoteSender(list_item_4)
# 6. Bake or view your results
tracked_planes_2 = RemoteReceiver(tracked_planes)
# 5. Record and store your results
tracked_planes_3 = RemoteReceiver(tracked_planes)
orient_2 = Orient(Geometry=tracked_objects_3, Source=origin_plane_3, Target=tracked_planes_2)  # -> Geometry, Transform

# ---- group: Record
record_capture = DataRecorder(tracked_planes_3, DataLimit=-10, RecordData=False)

# ----
plane_visualizer = PlaneVisualizer(Plane=tracked_planes_2)
output = Geometry(orient_2.Geometry)
explode_tree = ExplodeTree(Data=record_capture)  # -> Branch0, Branch1
geometry_2 = Geometry(explode_tree.Branch0)

# ----
# Realsense Pointcloud: RADII streamer
number_slider = Slider(0.05, range=0.01..5)
number_slider_2 = Slider(1.03, range=0.01..5)
number_slider_3 = Slider(0.5, range=0.25..1)
number_slider_4 = Slider(20, range=1..50)
number_slider_5 = Slider(0.4, range=0..1)
number_slider_6 = Slider(20, range=1..100)
boolean_toggle = BooleanToggle(False)
boolean_toggle_2 = BooleanToggle(False)
capturerealsense = CaptureRealSense(
    CameraPlane=PlaneXZ(0, 0, 0),
    ClipNear=number_slider,
    ClipFar=number_slider_2,
    SpatialAlpha=number_slider_3,
    SpatialDelta=number_slider_4,
    TemporalAlpha=number_slider_5,
    TemporalDelta=number_slider_6,
    Capture=boolean_toggle,
    On=boolean_toggle_2)  # -> PointCloud, CameraPlane

# ----
# Realsense Pointcloud: img
boolean_toggle_3 = BooleanToggle(False)
# System Time
# Params provided to user:
# 
# 1. a single button to start
# 2. select the number of sensors labels with the following type:
# 
# 
# 3. output directory
trigger = Trigger(Interval=50, TimerInterval=50, Target=realsense_livestream_img)  # disabled
realsense_livestream_img = Python3Script(Run=boolean_toggle_3, Reset=Toggle(False))  # -> out, status, depth_frame, color_frame, timestamp
# ---------- realsense_livestream_img: Python ----------
# r: pyrealsense2, numpy
import pyrealsense2 as rs
import numpy as np
import scriptcontext as sc
import Rhino
import System
import time
from System.Drawing import Bitmap
from System.Drawing.Imaging import PixelFormat

# Initialize output parameters
status = "Inactive"
Img = None

# --- Viewport HUD Overlay Setup ---
class LiveFeedConduit(Rhino.Display.DisplayConduit):
    def __init__(self):
        super().__init__()
        self.disp_bmp = None
        
    def update_image(self, sys_bitmap):
        if self.disp_bmp:
            self.disp_bmp.Dispose()
        self.disp_bmp = Rhino.Display.DisplayBitmap(sys_bitmap)
        
    def DrawForeground(self, e):
        if self.disp_bmp:
            e.Display.DrawBitmap(self.disp_bmp, 10, 10)
            
    def Clear(self):
        if self.disp_bmp:
            self.disp_bmp.Dispose()
            self.disp_bmp = None

def start_realsense():
    pipe = rs.pipeline()
    config = rs.config()
    config.enable_stream(rs.stream.color, 640, 480, rs.format.bgr8, 30)
    config.enable_stream(rs.stream.depth, 640, 480, rs.format.z16, 30)
    pipe.start(config)
    return pipe

def close_everything():
    if 'rs_pipeline' in sc.sticky:
        try:
            sc.sticky['rs_pipeline'].stop()
        except: pass
        del sc.sticky['rs_pipeline']
        
    if 'rs_conduit' in sc.sticky:
        try:
            sc.sticky['rs_conduit'].Enabled = False
            sc.sticky['rs_conduit'].Clear()
        except: pass
        del sc.sticky['rs_conduit']

# --- Execution Logic ---

if Reset or not Run:
    close_everything()
    Rhino.RhinoDoc.ActiveDoc.Views.Redraw()
    status = "Pipeline and HUD stopped clean."

if Run:
    if 'rs_conduit' not in sc.sticky:
        sc.sticky['rs_conduit'] = LiveFeedConduit()
        sc.sticky['rs_conduit'].Enabled = True
    conduit = sc.sticky['rs_conduit']
    
    if 'rs_pipeline' not in sc.sticky:
        try:
            sc.sticky['rs_pipeline'] = start_realsense()
            status = "Warming up camera..."
        except Exception as e:
            status = f"Init Error: {e}"
            Run = False
            
    if 'rs_pipeline' in sc.sticky:
        pipeline = sc.sticky['rs_pipeline']
        try:
            frames = pipeline.wait_for_frames(timeout_ms=200)
            color_frame = frames.get_color_frame()
            depth_frame = frames.get_depth_frame()
            
            if color_frame:
                color_image = np.asanyarray(color_frame.get_data())
                
                # Get array dimensions
                height, width, channels = color_image.shape
                stride = width * channels # Bytes per row
                
                # Grab the memory pointer of the raw NumPy array 
                ptr = System.IntPtr(color_image.__array_interface__['data'][0])
                
                # Instantly map the pointer to a .NET Bitmap (No encoding overhead!)
                temp_bmp = Bitmap(width, height, stride, PixelFormat.Format24bppRgb, ptr)
                
                # Create a deep copy so Grasshopper/Rhino safely own the pixels
                Img = Bitmap(temp_bmp)
                
                # Update Viewport Overlay HUD
                conduit.update_image(Img)
                
                # Free the pointer wrapper immediately
                temp_bmp.Dispose()
                
                Rhino.RhinoDoc.ActiveDoc.Views.Redraw()
                status = "Live Stream active inside Rhino & GH!"
                
        except Exception as e:
            status = f"Capture Error: {e}"
# ---------- end realsense_livestream_img ----------
panel_3 = Panel(realsense_livestream_img.status)

# ----
# Realsense Depth camera: img / ptcloud
number_slider_7 = Slider(2, range=0..10)
trigger_2 = Trigger(Interval=50, TimerInterval=50, Target=realsense_livestream)  # disabled
realsense_livestream = Python3Script(Run=Toggle(False), Reset=Button(), sampleStep=number_slider_7)  # -> status, Img, color_frame, depth_frame, StartTime, ElapsedTime, PointCloud; inputs Run: Boolean, Reset: Boolean, sampleStep: Int32
# ---------- realsense_livestream: Python ----------
# r: pyrealsense2, numpy
import pyrealsense2 as rs
import numpy as np
import scriptcontext as sc
import Rhino
import System
import time
import datetime
from System.Drawing import Bitmap
from System.Drawing.Imaging import PixelFormat

"""
Component Setup
Update your Rhino 8 CPython component to have these exact inputs and outputs:

Inputs:
    Run (Boolean Toggle) — Starts/stops the stream.
    Reset (Boolean Button) — Resets the stream and zeroes out the timestamp tracker.
    SampleStep (Integer) — Slicing factor for point cloud density. A value of 1 pulls all pixels. A value of 4 samples every 4th pixel, dramatically speeding up downstream components.

Outputs:
    status — Stream status logs.
    Img — Active color frame as a .NET Bitmap.
    StartTime — Absolute start earth timestamp string recorded exactly once upon stream initiation.
    ElapsedTime — High-precision elapsed time in seconds since the start time.
    PointCloud — A flat list of raw Rhino.Geometry.Point3d coordinates from the depth map.
"""

# Initialize output parameters safely
status = "Inactive"
Img = None
StartTime = "None"
ElapsedTime = 0.0
PointCloud = []

# Guard for SampleStep input (Default to sampling every 4th element for performance)
step = int(SampleStep) if ('SampleStep' in globals() and SampleStep is not None and SampleStep >= 1) else 4

# --- Viewport HUD Overlay Setup ---
class LiveFeedConduit(Rhino.Display.DisplayConduit):
    def __init__(self):
        super().__init__()
        self.disp_bmp = None
        
    def update_image(self, sys_bitmap):
        if self.disp_bmp:
            self.disp_bmp.Dispose()
        self.disp_bmp = Rhino.Display.DisplayBitmap(sys_bitmap)
        
    def DrawForeground(self, e):
        if self.disp_bmp:
            e.Display.DrawBitmap(self.disp_bmp, 10, 10)
            
    def Clear(self):
        if self.disp_bmp:
            self.disp_bmp.Dispose()
            self.disp_bmp = None

def start_realsense():
    pipe = rs.pipeline()
    config = rs.config()
    # Enable both Color and Depth streams at 640x480 resolution
    config.enable_stream(rs.stream.color, 640, 480, rs.format.bgr8, 30)
    config.enable_stream(rs.stream.depth, 640, 480, rs.format.z16, 30)
    pipe.start(config)
    return pipe

def close_everything():
    if 'rs_pipeline' in sc.sticky:
        try:
            sc.sticky['rs_pipeline'].stop()
        except: pass
        del sc.sticky['rs_pipeline']
        
    if 'rs_conduit' in sc.sticky:
        try:
            sc.sticky['rs_conduit'].Enabled = False
            sc.sticky['rs_conduit'].Clear()
        except: pass
        del sc.sticky['rs_conduit']
        
    if 'rs_pc' in sc.sticky:
        del sc.sticky['rs_pc']
        
    if 'rs_start_time_str' in sc.sticky:
        del sc.sticky['rs_start_time_str']
        
    if 'rs_start_perf' in sc.sticky:
        del sc.sticky['rs_start_perf']

# --- Execution Logic ---

if Reset or not Run:
    close_everything()
    Rhino.RhinoDoc.ActiveDoc.Views.Redraw()
    status = "Pipeline, HUD, and time sessions stopped clean."

if Run:
    # 1. Initialize Viewport Overlays
    if 'rs_conduit' not in sc.sticky:
        sc.sticky['rs_conduit'] = LiveFeedConduit()
        sc.sticky['rs_conduit'].Enabled = True
    conduit = sc.sticky['rs_conduit']
    
    # 2. Initialize Camera and PointCloud context
    if 'rs_pipeline' not in sc.sticky:
        try:
            sc.sticky['rs_pipeline'] = start_realsense()
            sc.sticky['rs_pc'] = rs.pointcloud()
            
            # Record absolute start time matching standard mocap file headers
            now = datetime.datetime.now()
            sc.sticky['rs_start_time_str'] = now.strftime("%Y-%m-%d %I.%M.%S.%f")[:-3] + " " + now.strftime("%p")
            sc.sticky['rs_start_perf'] = time.perf_counter() # High-precision CPU counter
            
            status = "Warming up streams..."
        except Exception as e:
            status = f"Init Error: {e}"
            Run = False
            
    if 'rs_pipeline' in sc.sticky:
        pipeline = sc.sticky['rs_pipeline']
        pc = sc.sticky['rs_pc']
        
        # Pass the static session start time to the component output
        StartTime = sc.sticky.get('rs_start_time_str', "None")
        
        try:
            frames = pipeline.wait_for_frames(timeout_ms=200)
            color_frame = frames.get_color_frame()
            depth_frame = frames.get_depth_frame()
            
            # Calculate high-precision elapsed seconds (Mocap frame-time equivalent)
            ElapsedTime = time.perf_counter() - sc.sticky['rs_start_perf']
            
            # 3. Compute and format PointCloud data (passed raw downstream)
            if depth_frame:
                points = pc.calculate(depth_frame)
                vtx = np.asanyarray(points.get_vertices()).view(np.float32).reshape(-1, 3)
                
                # Spatial downsampling using fast numpy array slicing [::step]
                vtx_sampled = vtx[::step]
                
                # Filter out points with zero depth or out-of-bounds tracking (RealSense units are in meters)
                mask = (vtx_sampled[:, 2] > 0.01) & (vtx_sampled[:, 2] < 10.0)
                valid_points = vtx_sampled[mask]
                
                # Instantly map to native Rhino Geometry points
                PointCloud = [Rhino.Geometry.Point3d(float(p[0]), float(p[1]), float(p[2])) for p in valid_points]
            
            # 4. Handle Color Frame for Viewport Display
            if color_frame:
                color_image = np.asanyarray(color_frame.get_data())
                height, width, channels = color_image.shape
                stride = width * channels
                
                ptr = System.IntPtr(color_image.__array_interface__['data'][0])
                temp_bmp = Bitmap(width, height, stride, PixelFormat.Format24bppRgb, ptr)
                Img = Bitmap(temp_bmp)
                
                conduit.update_image(Img)
                temp_bmp.Dispose()
                
                Rhino.RhinoDoc.ActiveDoc.Views.Redraw()
                status = f"Streaming frame at {ElapsedTime:.4f}s. Contained Points: {len(PointCloud)}"
                
        except Exception as e:
            status = f"Capture Error: {e}"
# ---------- end realsense_livestream ----------
panel_4 = Panel(realsense_livestream.status)

data_recorder = DataRecorder([realsense_livestream.depth_frame, realsense_livestream.ElapsedTime], DataLimit=-10, RecordData=True)
panel_5 = Panel(data_recorder)
