# Grasshopper definition 260527_MOCAP_Realsense_Grasshopper.gh (Grasshopper 1.0.8)
# plug-ins: Robot Components, RADiiCapture, Tracker, Telepathy

brep = Brep([<brep referenced from the Rhino model> x4])
panel = Panel("C:\Users\dfabadmin\Desktop\Diderot_data\plaster_stroke_parser-20260521T170611Z-3-001\plaster_stroke_parser\poses_only\plaster_novice_002__mocap_tracker.csv")

# ---- group: parse canvas height from select snippets
crv = Curve([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])
explode = Explode(Curve=crv, Recursive=True)  # -> Segments, flatten(Vertices)
pdecon = Deconstruct(Point=explode.Vertices)  # -> XComponent, YComponent, ZComponent
sort = SortList(Keys=pdecon.ZComponent)  # -> Keys, ValuesA
item = ListItem(List=sort.Keys, Index="-1", Wrap=True)
canvas_z = RemoteSender(item)

# ---- group: input
# Optitrack Motive <> Rhino Grasshopper Workflow
# CMU Architecture Robotics Lab
# 
# Template by Chloe Xu, 10.02.25.
# 1. Preparation
# Software: Optitrack Motive 3.3
# https://optitrack.com/software/motive/
# 
# Requires Motive physical license (accessible
# from lab computer)
# Requires connection to mocap cameras
# 
# Before recording, after setting up markers in
# physical space, select all relevant markers
# and join them into a rigid body.
# Workflow 1: Record mocap data in Motive
# and import to Grasshopper
# 2. Record Data in Motive
# Record motion in Motive
# 
# Export completed recording as CSV
# 
# *Note: currently there may be an issue with
# exporting data to other file paths, you can
# export to the default folder then move the file.
# 3. Import CSV in Grasshopper
# Set the import file path to your CSV, receive
# planes for recorded rigid bodies.
csv_path = FilePath("C:\Users\HFinchPC\Downloads\Take 2025-09-26 04.17.55 PM.csv")  # disabled

# ----
# Realsense Depth camera <> Rhino Grasshopper Workflow
# To do:
# Run both image and depth captures in realsense sdk (remove RADII usage, but offer as a backup)
# 
# provide recording template to synchronize MOCAP and depth camera in the same clock (with proper time-stamp)
# and save each episode as a file for ML training
# 
# 
# provide camera coordinate/plane <> MOCAP <> robot calibration procedures using fudcial markers
motive_csv_parser = Python3Script(CSVPath=csv_path)  # -> out, planes; inputs CSVPath: String; disabled
# ---------- motive_csv_parser: Python ----------
#requirements: pandas

## A single purpose script to parse motive tracker version 3.3 csv export data.
## Rigid bodies represented as GH planes using Rhino Script Syntax.
## Note, script currently only works for a single rigid body.
## Josh Bard, Carnegie Mellon University 01.20.17 (ver 1.5 Motive)
## Modified by Chloe Xu, Carnegie Mellon University 10.02.25 (ver 3.3 Motive)
    
    # CSV Parsing: Rigid Body location and orientation found in "frames" rows
    # labels span rows 2-7, including
    # Type (Rigid Body / Rigid Body Marker / Marker) (this script considers only rb)
    # Name (as defined in Motive)
    # ID (GUID as assigned by Motive)
    # Parent (if Rigid Body Marker)
    # Rotation / Position (whether the variable denotes rb rotation or position)
    # Specific Data Labels (which coordinate does the column represent)

    # Per rb plane, the following information is recorded
    # Position: xPosition, yPosition, zPosition
    # Orientation: axis of rotation (rx, ry, rz), 
    #              radians of rotation (rw)

## Modification Note (10.01.25):
## Since previous version, organization of variables in the csv have changed,
## most notably, method or rotation calculation is different. Original method
## employed yaw-pitch-roll style and has since been changed by Motive to quaternion.

## Current version also supports parsing of more than one rigid body, 
    ################################################################
    ################################################################

import math
import pandas as pd
import rhinoscriptsyntax as rs


def plane_from_quat(x, y, z, qx, qy, qz, qw):
    n = math.sqrt(qx*qx + qy*qy + qz*qz + qw*qw)
    if n == 0:
        return rs.MovePlane(rs.WorldXYPlane(), (x, y, z))
    xq, yq, zq, wq = qx/n, qy/n, qz/n, qw/n
    r00 = 1 - 2*(yq*yq + zq*zq); r01 = 2*(xq*yq - zq*wq); r02 = 2*(xq*zq + yq*wq)
    r10 = 2*(xq*yq + zq*wq);     r11 = 1 - 2*(xq*xq + zq*zq); r12 = 2*(yq*zq - xq*wq)
    r20 = 2*(xq*zq - yq*wq);     r21 = 2*(yq*zq + xq*wq);     r22 = 1 - 2*(xq*xq + yq*yq)

    def rot(v):
        vx, vy, vz = v
        return (r00*vx + r01*vy + r02*vz,
                r10*vx + r11*vy + r12*vz,
                r20*vx + r21*vy + r22*vz)

    origin = (x, y, z)
    xaxis  = rot((1.0, 0.0, 0.0))
    yaxis  = rot((0.0, 1.0, 0.0))
    return rs.PlaneFromFrame(origin, xaxis, yaxis)


def mocap_planes_to_branches(csv_path, mm_to_model=1.0):
    """
    Returns (names, branches)
      names:   list of rigid-body names (sorted)
      branches: list of lists of Rhino planes (one branch per rigid body)
    """
    df = pd.read_csv(csv_path, header=None, skiprows = 2)
    # find the 'Frame, Time (Seconds)' header row
    frame_row = df.index[df.iloc[:,0].astype(str) == 'Frame'][0]

    # the 5 rows above define column meta:
    # Type, Name, ID, Parent, Field(Rotation/Position), then component row (X/Y/Z/W)
    type_row  = df.iloc[frame_row-5].fillna('')
    name_row  = df.iloc[frame_row-4].fillna('')
    field_row = df.iloc[frame_row-1].fillna('')
    comp_row  = df.iloc[frame_row  ].fillna('')

    data = df.iloc[frame_row+1:].reset_index(drop=True)

    # mask rigid-body columns
    is_rb = (type_row == 'Rigid Body') & (name_row != '') # ignore markers

    rb_names = name_row[is_rb]
    bodies = sorted(rb_names.unique())

    branches = []
    for nm in bodies:
        # columns that belong to this rigid body
        cols_nm = (name_row == nm)

        # find the indices for Position {X,Y,Z} and Rotation {X,Y,Z,W}
        pos_idx = {label: idx for idx, label in comp_row[(cols_nm) & (field_row=='Position') & (comp_row.isin(['X','Y','Z']))].items()}
        rot_idx = {label: idx for idx, label in comp_row[(cols_nm) & (field_row=='Rotation') & (comp_row.isin(['X','Y','Z','W']))].items()}


        # must have all required components
        if not ({'X','Y','Z'} <= set(pos_idx) and {'X','Y','Z','W'} <= set(rot_idx)):
            continue

        # extract numeric arrays
        px = pd.to_numeric(data.iloc[:, pos_idx['X']], errors='coerce') * mm_to_model
        py = pd.to_numeric(data.iloc[:, pos_idx['Y']], errors='coerce') * mm_to_model
        pz = pd.to_numeric(data.iloc[:, pos_idx['Z']], errors='coerce') * mm_to_model
        qx = pd.to_numeric(data.iloc[:, rot_idx['X']], errors='coerce')
        qy = pd.to_numeric(data.iloc[:, rot_idx['Y']], errors='coerce')
        qz = pd.to_numeric(data.iloc[:, rot_idx['Z']], errors='coerce')
        qw = pd.to_numeric(data.iloc[:, rot_idx['W']], errors='coerce')

        # build planes per frame (skip rows with NaNs)
        planes = []
        for X,Y,Z,QX,QY,QZ,QW in zip(px,py,pz,qx,qy,qz,qw):
            if pd.isna(X) or pd.isna(Y) or pd.isna(Z) or pd.isna(QX) or pd.isna(QY) or pd.isna(QZ) or pd.isna(QW):
                continue
            planes.append(plane_from_quat(float(X), float(Y), float(Z),
                                          float(QX), float(QY), float(QZ), float(QW)))
        branches.append(planes)

    return bodies, branches


def to_datatree(branches):
    try:
        from ghpythonlib import treehelpers as th
        return th.list_to_tree(branches)
    except ImportError:
        return branches


names, branches = mocap_planes_to_branches(CSVPath, mm_to_model=1.0)  # 1.0 if your Rhino units are mm; 0.001 if meters
planes = to_datatree(branches)
# ---------- end motive_csv_parser ----------
trowel_z = RemoteSender(Slider(0, range=-0.1..0.1))
trowel_z_2 = RemoteReceiver(trowel_z)
Z = UnitZ(Factor=trowel_z_2)
move = Move(Geometry=brep, Motion=Z)  # -> Geometry, Transform
py3 = Python3Script(csv_path=panel, swap_yz="1")  # -> out, planes; inputs csv_path: String, swap_yz: Boolean; disabled
# ---------- py3: Python ----------
# GhPython: CSV -> [Plane] with optional Y<->Z swap
# Inputs:
#   csv_path: str
#   swap_yz:  bool
# Outputs:
#   Planes: list[Rhino.Geometry.Plane]
#   Times:  list[float]

import os, math, csv
import Rhino.Geometry as rg

def quat_to_mat3(qx, qy, qz, qw):
    n = math.sqrt(qw*qw + qx*qx + qy*qy + qz*qz)
    if n == 0.0: qw,qx,qy,qz = 1.0,0.0,0.0,0.0
    else: qw,qx,qy,qz = qw/n, qx/n, qy/n, qz/n
    xx,yy,zz = qx*qx, qy*qy, qz*qz
    xy,xz,yz = qx*qy, qx*qz, qy*qz
    wx,wy,wz = qw*qx, qw*qy, qw*qz
    m00 = 1 - 2*(yy + zz); m01 = 2*(xy - wz);   m02 = 2*(xz + wy)
    m10 = 2*(xy + wz);     m11 = 1 - 2*(xx + zz); m12 = 2*(yz - wx)
    m20 = 2*(xz - wy);     m21 = 2*(yz + wx);   m22 = 1 - 2*(xx + yy)
    return ((m00,m01,m02),(m10,m11,m12),(m20,m21,m22))

def mat_mul(A, B):
    return tuple(tuple(sum(A[i][k]*B[k][j] for k in range(3)) for j in range(3)) for i in range(3))

def mat_T(A):
    return ((A[0][0],A[1][0],A[2][0]),
            (A[0][1],A[1][1],A[2][1]),
            (A[0][2],A[1][2],A[2][2]))

def mat3_to_plane(origin, M):
    x = rg.Vector3d(M[0][0], M[0][1], M[0][2])
    y = rg.Vector3d(M[1][0], M[1][1], M[1][2])
    if x.IsZero or y.IsZero:
        return rg.Plane(origin, rg.Vector3d.XAxis, rg.Vector3d.YAxis)
    x.Unitize(); y.Unitize()
    return rg.Plane(origin, x, y)

if not csv_path or not os.path.exists(csv_path):
    raise ValueError("CSV path missing or not found.")

# Permutation for Y<->Z swap
P = ((1,0,0),(0,0,1),(0,1,0)) if swap_yz else ((1,0,0),(0,1,0),(0,0,1))

planes, times = [], []

# Read CSV (expects columns: t, px, py, pz, qx, qy, qz, qw; header optional)
with open(csv_path, 'rb') as fb:
    raw = fb.read()
text = None
for enc in ('utf-8-sig','utf-8'):
    try: text = raw.decode(enc); break
    except: pass
if text is None:
    raise ValueError("Unable to decode CSV as UTF-8/UTF-8-SIG.")

reader = csv.reader(text.splitlines())
header_checked = False

for row in reader:
    if not row: continue
    if not header_checked:
        header_checked = True
        try: float(row[0]); float(row[1])
        except: continue  # skip header
    row = (row + ['']*8)[:8]
    t, px, py, pz, qx, qy, qz, qw = [float(x) for x in row]

    # position: p' = P * p
    p = (px, py, pz)
    p_adj = (
        P[0][0]*p[0] + P[0][1]*p[1] + P[0][2]*p[2],
        P[1][0]*p[0] + P[1][1]*p[1] + P[1][2]*p[2],
        P[2][0]*p[0] + P[2][1]*p[1] + P[2][2]*p[2],
    )
    origin = rg.Point3d(p_adj[0], p_adj[1], p_adj[2])

    # orientation: R' = P * R * P^T
    R = quat_to_mat3(qx, qy, qz, qw)
    R_adj = mat_mul(mat_mul(P, R), mat_T(P))

    plane = mat3_to_plane(origin, R_adj)
    planes.append(plane)
    times.append(t)
# ---------- end py3 ----------
trowel = RemoteSender(move.Geometry)

# ---- group: output
# Workflow 2: Stream data from Motive
# to Grasshopper
# 2. Install Streaming Plugin
# Software: Optitrack-gh
# https://github.com/rhughes42/optitrack-
# gh/releases
# 
# 1. Open "Special Components" folder from
# Grasshopper "File" tab
# 2. Download plugin release form Github
# 3. Drag ZIP file into "Special Components" folder
# 4. Right click on ZIP file and select "Unblock",
# then "Apply"
# 5. Unzip ZIP file in the folder
# 6. Delete ZIP file
# 7. Restart Rhino
# 3. Setup Base Geometry
# 1. If applicable, set geometry that you want
# to be moved / rotated along with tracked
# rigid bodies.
# 2. Set up base reference plane of the
# geometry.
# 3. Transformations will be preformed on the
# object by translating your base plane to the
# output planes in Motive.
# 4. Setup Streaming from Motive
# 1. In Motive, streaming settings are at the
# bottom right of the window (double click
# broadcast icon)
# 2. Before activating streaming, ensure settings
# are configured to "Multitrack" and the local
# interface is "Loopback"
# 3. Start Streaming
# 4. In this template, right click the OptiTrack
# Stream component and check "Rigid Body"
# 5. Activate the OptiTrack Stream component
rb_planes = Plane(motive_csv_parser.planes)  # disabled

# ---- group: parse table height
item_2 = ListItem(List=py3.planes, Index=0, Wrap=True)
deplane = DeconstructPlane(Plane=item_2)  # -> Origin, XAxis, YAxis, ZAxis
pdecon_2 = Deconstruct(Point=deplane.Origin)  # -> XComponent, YComponent, ZComponent
neg = Negative(Value=pdecon_2.ZComponent)
Z_2 = UnitZ(Factor=neg)

# ----
canvas_z_2 = RemoteReceiver(canvas_z)
table_z = RemoteReceiver()
move_2 = Move(Geometry=py3.planes, Motion=Z_2)  # -> Geometry, Transform
lng = ListLength(List=move_2.Geometry)
deplane_2 = DeconstructPlane(Plane=move_2.Geometry)  # -> Origin, XAxis, YAxis, ZAxis
multiplication = Multiplication(A=lng, B=Slider(1, range=0..1))

# ---- group: Geometry Setup
tracked_objects = Geometry(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)
origin_point = Point(Point(0, 0, 0))
origin_x = Vector(Vector(1, 0, 0))
origin_y = Vector(Vector(0, 1, 0))
pl = ConstructPlane(Origin=origin_point, XAxis=origin_x, YAxis=origin_y)
origin_plane = Geometry(pl)

# ----
round = Round(Number=multiplication)  # -> Nearest, Floor, Ceiling

# ---- group: Stream Connector
optitrack_stream = OptiTrackStream(Activate=Toggle(False), Reset=Button(), LocalIP="127.0.0.1", ServerIP="127.0.0.1")  # -> Status, Markers, Labels, RBName, BRPlane

# ----
pline = PolyLine(Vertices=deplane_2.Origin, Closed=False)
crv_2 = Curve(pline)
item_3 = ListItem(List=move_2.Geometry, Index=round.Floor, Wrap=True)
tracked_objects_2 = RemoteSender(tracked_objects)
tracked_objects_3 = RemoteReceiver(tracked_objects_2)
origin_plane_2 = RemoteSender(origin_plane)
origin_plane_3 = RemoteReceiver(origin_plane_2)
cset = CreateSet(List=optitrack_stream.RBName)  # -> Set, Map
deplane_3 = DeconstructPlane(Plane=item_3)  # -> Origin, XAxis, YAxis, ZAxis
trowel_2 = RemoteReceiver(trowel)
orient = Orient(Geometry=trowel_2, Source=PlaneXY(0, 0, 0), Target=item_3)  # -> Geometry, Transform
pdecon_3 = Deconstruct(Point=deplane_3.Origin)  # -> XComponent, YComponent, ZComponent
item_4 = ListItem(List=optitrack_stream.BRPlane, Index=cset.Map, Wrap=True)
geo = Geometry(orient.Geometry)
panel_2 = Panel(optitrack_stream.Status)
tracked_planes = RemoteSender(item_4)
# 6. Bake or view your results
tracked_planes_2 = RemoteReceiver(tracked_planes)
# 5. Record and store your results
tracked_planes_3 = RemoteReceiver(tracked_planes)
orient_2 = Orient(Geometry=tracked_objects_3, Source=origin_plane_3, Target=tracked_planes_2)  # -> Geometry, Transform

# ---- group: Record
record_capture = DataRecorder(tracked_planes_3, DataLimit=-10, RecordData=False)

# ----
pv = PlaneVisualizer(Plane=tracked_planes_2)
output = Geometry(orient_2.Geometry)
bang = ExplodeTree(Data=record_capture)  # -> Branch0, Branch1
geo_2 = Geometry(bang.Branch0)

# ----
# Realsense Pointcloud: RADII streamer
# 
# use this for downsized/finetuned/cropped
#  pointcloud, make sure intel realsense is plugged
# to the laptop before toggling On and Capture
# 
# Toggle sequence:
# 1. On
# 2. Capture
number_slider = Slider(0.05, range=0.01..5)
number_slider_2 = Slider(1.03, range=0.01..5)
number_slider_3 = Slider(0.5, range=0.25..1)
number_slider_4 = Slider(20, range=1..50)
number_slider_5 = Slider(0.4, range=0..1)
number_slider_6 = Slider(20, range=1..100)
boolean_toggle = BooleanToggle(False)
boolean_toggle_2 = BooleanToggle(False)
capturerealsense = CaptureRealSense(
    CameraPlane=PlaneXZ(0, 0, 0),
    ClipNear=number_slider,
    ClipFar=number_slider_2,
    SpatialAlpha=number_slider_3,
    SpatialDelta=number_slider_4,
    TemporalAlpha=number_slider_5,
    TemporalDelta=number_slider_6,
    Capture=boolean_toggle,
    On=boolean_toggle_2)  # -> PointCloud, CameraPlane

relay = Relay()

# ----
# Episode Recorder
toggle = BooleanToggle(False)
toggle_2 = BooleanToggle(False)
py3_2 = Python3Script(
    enabled=toggle,
    record=toggle_2,
    save_root="C:/Users/dfabadmin/Desktop/Diderot_data/dataset_collection",
    prefix="plaster_demo",
    dataset_name="2025_05_27_test",
    reset=Button())  # -> out, a
# ---------- py3_2: Python ----------
"""
Grasshopper Python 3 component: SIMPLE Episode Controller (SDK Class Mode)
==========================================================================
"""
import System
import Rhino
import Grasshopper
import os
import json
import time

class MyComponent(Grasshopper.Kernel.GH_ScriptInstance):
    def __init__(self):
        super(MyComponent, self).__init__()
        # State tracking variables survive on this instance across component calculations
        self.dataset_dir = ""
        self.episode_dir = ""
        self.episode_name = ""
        self.episode_index = 0
        self.prev_record = False

    def RunScript(self, enabled, record, save_root, prefix, dataset_name, reset):
        # 1. Check Component Resets
        if reset:
            self.dataset_dir = ""
            self.episode_dir = ""
            self.episode_name = ""
            self.episode_index = 0
            self.prev_record = False
            return False, "", "", "", 0, "State reset by button trigger."

        if not enabled:
            return False, "", "", "", 0, "Controller disabled."

        status_msg = "Ready."
        record_out = bool(record)

        # 2. Main Parent Dataset Directory Setup
        if not self.dataset_dir and save_root:
            if dataset_name and str(dataset_name).strip():
                ds_name = str(dataset_name).strip()
            else:
                timestamp = time.strftime("%Y%m%d_%H%M%S")
                ds_name = f"{prefix}_{timestamp}" if prefix else timestamp
            
            self.dataset_dir = os.path.join(str(save_root), ds_name)
            try:
                os.makedirs(self.dataset_dir, exist_ok=True)
                meta_path = os.path.join(self.dataset_dir, "dataset_meta.json")
                meta_data = {
                    "dataset_name": ds_name,
                    "created_time": time.strftime("%Y-%m-%d %H:%M:%S"),
                    "created_wall_time_ns": int(time.time_ns())
                }
                with open(meta_path, "w") as f:
                    json.dump(meta_data, f, indent=2)
            except Exception as e:
                return False, "", "", "", 0, f"Error creating folder: {str(e)}"

        # 3. Handle Transitions
        if self.dataset_dir:
            # Rising Edge: False -> True (Start Record)
            if record and not self.prev_record:
                self.episode_index += 1
                self.episode_name = f"episode_{self.episode_index:03d}"
                self.episode_dir = os.path.join(self.dataset_dir, self.episode_name)
                
                try:
                    os.makedirs(self.episode_dir, exist_ok=True)
                    ep_meta_path = os.path.join(self.episode_dir, "episode_meta.json")
                    ep_meta = {
                        "episode_name": self.episode_name,
                        "episode_index": self.episode_index,
                        "started_time": time.strftime("%Y-%m-%d %H:%M:%S"),
                        "started_wall_time_ns": int(time.time_ns()),
                        "started_perf_counter_ns": int(time.perf_counter_ns())
                    }
                    with open(ep_meta_path, "w") as f:
                        json.dump(ep_meta, f, indent=2)
                except Exception:
                    pass

            # Falling Edge: True -> False (Stop Record)
            elif not record and self.prev_record and self.episode_dir:
                try:
                    ep_meta_path = os.path.join(self.episode_dir, "episode_meta.json")
                    if os.path.exists(ep_meta_path):
                        with open(ep_meta_path, "r") as f:
                            ep_meta = json.load(f)
                    else:
                        ep_meta = {}
                    ep_meta["stopped_wall_time_ns"] = int(time.time_ns())
                    ep_meta["stopped_perf_counter_ns"] = int(time.perf_counter_ns())
                    with open(ep_meta_path, "w") as f:
                        json.dump(ep_meta, f, indent=2)
                except Exception:
                    pass

            self.prev_record = bool(record)

            if record_out:
                status_msg = f"Recording {self.episode_name}"
            elif self.episode_dir:
                status_msg = f"Stopped. Last episode: {self.episode_name}"
            else:
                status_msg = f"Ready. Toggle record=True to start episode_{self.episode_index + 1:03d}."

        # Return values match output positions from top to bottom on your component pin list
        return record_out, self.dataset_dir, self.episode_dir, self.episode_name, int(self.episode_index), status_msg
# ---------- end py3_2 ----------
panel_3 = Panel(py3_2.a)

# ----
# Realsense Stream
dp_rs_stream = DP05RealSenseRGBDStreamer(Enable=relay)  # -> ImagePacket, ImageT, DepthPacket, DepthT, PreviewRGB, PreviewDepth, Status, Frames, Dropped
# ---------- dp_rs_stream: Python ----------
"""
Grasshopper Python 3 component: DP 05 RealSense RGBD Streamer
==============================================================
Purpose
-------
Persistent RealSense camera streamer for the independent-recorder workflow.
This component starts the RealSense pipeline once, keeps it running in a
background thread, and outputs the latest timestamped RGB/depth packets.

It does NOT have a record input. Recorder toggles should never start/stop this
component. The stream only starts/stops with enable_stream or reset.

Typical wiring
--------------
    DP 05 RealSense RGBD Streamer
        image_packet  -> DP 01 Image Recorder / image_packet
        image_t_ns    -> optional DP 01 Image Recorder / t_ns
        depth_packet  -> DP 02 Depth Image Recorder / depth_packet
        depth_t_ns    -> optional DP 02 Depth Image Recorder / t_ns

For two cameras, duplicate this component:
    streamer A sensor_name = camera1, serial = <camera 1 serial>
    streamer B sensor_name = camera2, serial = <camera 2 serial>

Create these Grasshopper inputs, in this exact order:
    0 enable_stream        bool    True = keep camera running. False = stop stream.
    1 sensor_name          str     Base name, e.g. camera1 or wrist_cam.
    2 serial               str     Optional RealSense serial. Empty = first available camera.
    3 width                int     Color/depth width. Default 640.
    4 height               int     Color/depth height. Default 480.
    5 fps                  int     Camera FPS. Default 30.
    6 use_depth            bool    Enable depth stream. Default True.
    7 align_depth          bool    Align depth to color. Default True.
    8 apply_filters        bool    Apply depth filters. Default False.
    9 sample_rate_hz       float   Output throttle. 0 or empty = camera FPS.
    10 preview_every_n     int     Only update preview every N frames. Default 5.
    11 reset               bool    Momentary button. Stops/removes this streamer state.

Create these Grasshopper outputs, in this exact order:
    0 image_packet         object  Dict: {sensor,t_ns,seq,image/color/rgb,width,height,...}
    1 image_t_ns           int     Same timestamp as image_packet['t_ns'].
    2 depth_packet         object  Dict: {sensor,t_ns,seq,depth/aligned_depth,width,height,...}
    3 depth_t_ns           int     Same timestamp as depth_packet['t_ns'].
    4 preview_image        object  Downsampled RGB preview array, or latest RGB array.
    5 preview_depth        object  Downsampled depth preview array, or latest depth array.
    6 status               str     Human-readable status.
    7 frame_count          int     Number of frames emitted by this streamer.
    8 dropped_count        int     Frames skipped by sample-rate throttling.

Packet convention
-----------------
    t_ns = int(time.perf_counter_ns())

This timestamp is a monotonic int64 nanosecond timestamp from the same Rhino
Python process. All independent recorders can later be paired by nearest t_ns.
For a single RGBD frameset, image_packet['t_ns'] and depth_packet['t_ns'] are the
same value so RGB and aligned depth are already mutually referable.

Expected by existing recorder files
-----------------------------------
DP 01 Image Recorder accepts dict keys:
    image/color/rgb + t_ns

DP 02 Depth Image Recorder accepts dict keys:
    depth/aligned_depth/depth_image + t_ns
"""

import time
import threading
import traceback
import scriptcontext as sc

# -----------------------------------------------------------------------------
# Grasshopper UI annotation
# -----------------------------------------------------------------------------

def _annotate_gh_component():
    try:
        comp = ghenv.Component
        comp.Name = "DP 05 RealSense RGBD Streamer"
        comp.NickName = "DP_RS_Stream"
        comp.Description = (
            "Persistent RealSense RGBD streamer. Outputs timestamped image/depth "
            "packets for independent recorders. No record toggle input."
        )
        input_specs = [
            ("enable_stream", "Enable", "True = start/keep RealSense running. False = stop camera stream."),
            ("sensor_name", "Sensor", "Base name, e.g. camera1 or wrist_cam. Packets use camera1_image/camera1_aligned_depth."),
            ("serial", "Serial", "Optional RealSense serial number. Empty = first available camera."),
            ("width", "Width", "Image width. Default 640."),
            ("height", "Height", "Image height. Default 480."),
            ("fps", "FPS", "RealSense stream FPS. Default 30."),
            ("use_depth", "UseDepth", "Enable depth stream. Default True."),
            ("align_depth", "AlignDepth", "Align depth to color. Default True."),
            ("apply_filters", "Filters", "Apply RealSense depth spatial/temporal/hole filling filters. Default False."),
            ("sample_rate_hz", "SampleHz", "Output throttle. 0/empty = use camera FPS."),
            ("preview_every_n", "PreviewN", "Update preview every N emitted frames. Default 5."),
            ("reset", "Reset", "Momentary button. Stop stream and clear this component state."),
        ]
        output_specs = [
            ("image_packet", "ImagePacket", "Dict with RGB image and t_ns. Connect to DP 01 Image Recorder / image_packet."),
            ("image_t_ns", "ImageT", "Timestamp from image_packet['t_ns']."),
            ("depth_packet", "DepthPacket", "Dict with depth/aligned_depth and t_ns. Connect to DP 02 Depth Recorder / depth_packet."),
            ("depth_t_ns", "DepthT", "Timestamp from depth_packet['t_ns']."),
            ("preview_image", "PreviewRGB", "Preview RGB ndarray. Avoid passing this to the recorder."),
            ("preview_depth", "PreviewDepth", "Preview depth ndarray. Avoid passing this to the recorder."),
            ("status", "Status", "Human-readable stream status."),
            ("frame_count", "Frames", "Number of timestamped packets emitted."),
            ("dropped_count", "Dropped", "Frames skipped by sample-rate throttling."),
        ]
        for i, spec in enumerate(input_specs):
            if i < comp.Params.Input.Count:
                comp.Params.Input[i].Name = spec[0]
                comp.Params.Input[i].NickName = spec[1]
                comp.Params.Input[i].Description = spec[2]
        for i, spec in enumerate(output_specs):
            if i < comp.Params.Output.Count:
                comp.Params.Output[i].Name = spec[0]
                comp.Params.Output[i].NickName = spec[1]
                comp.Params.Output[i].Description = spec[2]
    except Exception:
        pass

_annotate_gh_component()

# -----------------------------------------------------------------------------
# Helpers
# -----------------------------------------------------------------------------

def _g(name, default=None):
    return globals().get(name, default)


def _safe_name(text, fallback="camera"):
    text = str(text or "").strip() or fallback
    return "".join(ch if (ch.isalnum() or ch in ["_", "-", "."]) else "_" for ch in text)


def _component_key(sensor_name):
    try:
        return "DP_REALSENSE_STREAMER_{}_{}".format(ghenv.Component.InstanceGuid, sensor_name)
    except Exception:
        return "DP_REALSENSE_STREAMER_DEFAULT_{}".format(sensor_name)


def _to_int(value, default):
    try:
        if value is None or str(value) == "":
            return int(default)
        return int(value)
    except Exception:
        return int(default)


def _to_float(value, default):
    try:
        if value is None or str(value) == "":
            return float(default)
        return float(value)
    except Exception:
        return float(default)


def _resize_preview(arr, max_w=320):
    """Return a lightweight preview copy. Keep full packet arrays untouched."""
    if arr is None:
        return None
    try:
        import numpy as np
        a = np.asarray(arr)
        h, w = a.shape[:2]
        if w <= max_w:
            return a.copy()
        scale = float(max_w) / float(w)
        new_w = int(w * scale)
        new_h = int(h * scale)
        try:
            import cv2
            return cv2.resize(a, (new_w, new_h), interpolation=cv2.INTER_AREA)
        except Exception:
            # Simple stride fallback if cv2 is unavailable.
            step = max(1, int(round(1.0 / scale)))
            return a[::step, ::step].copy()
    except Exception:
        return arr


# -----------------------------------------------------------------------------
# Streamer state
# -----------------------------------------------------------------------------

class RealSenseRGBDStreamerState(object):
    def __init__(self, sensor_name):
        self.sensor_name = sensor_name
        self.running = False
        self.thread = None
        self.lock = threading.Lock()
        self.latest_image_packet = None
        self.latest_depth_packet = None
        self.preview_image = None
        self.preview_depth = None
        self.frame_count = 0
        self.dropped_count = 0
        self.last_error = ""
        self.last_config = None
        self.depth_scale = None
        self.started_wall_time_ns = 0

    def start(self, config):
        """Start stream if not running, or restart if configuration changed."""
        if self.running and self.last_config == config:
            return
        if self.running:
            self.stop()
        self.last_config = dict(config)
        self.running = True
        self.last_error = ""
        self.frame_count = 0
        self.dropped_count = 0
        self.started_wall_time_ns = time.time_ns()
        self.thread = threading.Thread(target=self._loop, args=(dict(config),), daemon=True)
        self.thread.start()

    def stop(self):
        self.running = False
        th = self.thread
        self.thread = None
        if th is not None and th.is_alive():
            try:
                th.join(1.0)
            except Exception:
                pass

    def reset(self):
        self.stop()
        with self.lock:
            self.latest_image_packet = None
            self.latest_depth_packet = None
            self.preview_image = None
            self.preview_depth = None
            self.frame_count = 0
            self.dropped_count = 0
            self.last_error = ""
            self.last_config = None
            self.depth_scale = None
            self.started_wall_time_ns = 0

    def get_outputs(self):
        with self.lock:
            img = self.latest_image_packet
            dep = self.latest_depth_packet
            pimg = self.preview_image
            pdep = self.preview_depth
            fc = int(self.frame_count)
            dc = int(self.dropped_count)
            err = self.last_error
            running = bool(self.running)
            cfg = self.last_config
        return img, dep, pimg, pdep, fc, dc, err, running, cfg

    def _loop(self, config):
        pipeline = None
        try:
            import numpy as np
            import pyrealsense2 as rs
            try:
                import cv2
            except Exception:
                cv2 = None

            sensor_name = config["sensor_name"]
            serial = config["serial"]
            width = int(config["width"])
            height = int(config["height"])
            fps = int(config["fps"])
            use_depth = bool(config["use_depth"])
            align_depth = bool(config["align_depth"])
            apply_filters = bool(config["apply_filters"])
            sample_rate_hz = float(config["sample_rate_hz"])
            preview_every_n = max(1, int(config["preview_every_n"]))

            pipeline = rs.pipeline()
            rs_config = rs.config()
            if serial:
                rs_config.enable_device(serial)
            rs_config.enable_stream(rs.stream.color, width, height, rs.format.bgr8, fps)
            if use_depth:
                rs_config.enable_stream(rs.stream.depth, width, height, rs.format.z16, fps)

            profile = pipeline.start(rs_config)

            depth_scale = None
            if use_depth:
                try:
                    depth_sensor = profile.get_device().first_depth_sensor()
                    depth_scale = float(depth_sensor.get_depth_scale())
                except Exception:
                    depth_scale = None

            align = rs.align(rs.stream.color) if (use_depth and align_depth) else None

            # Optional filters. Kept conservative because GH/Rhino machine setups vary.
            spatial_filter = rs.spatial_filter() if (use_depth and apply_filters) else None
            temporal_filter = rs.temporal_filter() if (use_depth and apply_filters) else None
            hole_filter = rs.hole_filling_filter() if (use_depth and apply_filters) else None

            min_period = 0.0
            if sample_rate_hz and sample_rate_hz > 0:
                min_period = 1.0 / sample_rate_hz
            last_emit_perf = 0.0
            seq = 0

            with self.lock:
                self.depth_scale = depth_scale

            while self.running:
                frames = pipeline.wait_for_frames()

                # Throttle output packets without stopping camera acquisition.
                now_perf = time.perf_counter()
                if min_period > 0 and (now_perf - last_emit_perf) < min_period:
                    with self.lock:
                        self.dropped_count += 1
                    continue
                last_emit_perf = now_perf

                if align is not None:
                    frames = align.process(frames)

                color_frame = frames.get_color_frame()
                if not color_frame:
                    continue

                depth_frame = None
                if use_depth:
                    depth_frame = frames.get_depth_frame()
                    if depth_frame is not None and apply_filters:
                        if spatial_filter is not None:
                            depth_frame = spatial_filter.process(depth_frame)
                        if temporal_filter is not None:
                            depth_frame = temporal_filter.process(depth_frame)
                        if hole_filter is not None:
                            depth_frame = hole_filter.process(depth_frame)

                # Canonical timestamp assigned when a coherent frameset is accepted.
                t_ns = int(time.perf_counter_ns())
                wall_time_ns = int(time.time_ns())
                seq += 1

                color_bgr = np.asanyarray(color_frame.get_data())
                if cv2 is not None:
                    color_rgb = cv2.cvtColor(color_bgr, cv2.COLOR_BGR2RGB).copy()
                else:
                    color_rgb = color_bgr[:, :, ::-1].copy()

                try:
                    rs_color_timestamp_ms = float(color_frame.get_timestamp())
                except Exception:
                    rs_color_timestamp_ms = None

                image_packet = {
                    "sensor": sensor_name + "_image",
                    "sensor_base": sensor_name,
                    "stream_type": "rgb",
                    "seq": int(seq),
                    "t_ns": t_ns,
                    "timestamp_ns": t_ns,
                    "wall_time_ns": wall_time_ns,
                    "image": color_rgb,
                    "color": color_rgb,
                    "rgb": color_rgb,
                    "width": int(color_rgb.shape[1]),
                    "height": int(color_rgb.shape[0]),
                    "channels": int(color_rgb.shape[2]) if color_rgb.ndim == 3 else 1,
                    "serial": serial,
                    "rs_timestamp_ms": rs_color_timestamp_ms,
                }

                depth_packet = None
                depth_np = None
                if use_depth and depth_frame is not None:
                    depth_np = np.asanyarray(depth_frame.get_data()).copy()
                    try:
                        rs_depth_timestamp_ms = float(depth_frame.get_timestamp())
                    except Exception:
                        rs_depth_timestamp_ms = None
                    depth_packet = {
                        "sensor": sensor_name + ("_aligned_depth" if align_depth else "_depth"),
                        "sensor_base": sensor_name,
                        "stream_type": "aligned_depth" if align_depth else "depth",
                        "seq": int(seq),
                        "t_ns": t_ns,
                        "timestamp_ns": t_ns,
                        "wall_time_ns": wall_time_ns,
                        "depth": depth_np,
                        "aligned_depth": depth_np if align_depth else None,
                        "depth_image": depth_np,
                        "width": int(depth_np.shape[1]),
                        "height": int(depth_np.shape[0]),
                        "dtype": str(depth_np.dtype),
                        "serial": serial,
                        "depth_scale": depth_scale,
                        "aligned_to": sensor_name + "_image" if align_depth else "none",
                        "rs_timestamp_ms": rs_depth_timestamp_ms,
                    }

                update_preview = (seq % preview_every_n == 0)
                with self.lock:
                    self.latest_image_packet = image_packet
                    self.latest_depth_packet = depth_packet
                    self.frame_count = int(seq)
                    if update_preview:
                        self.preview_image = _resize_preview(color_rgb)
                        self.preview_depth = _resize_preview(depth_np) if depth_np is not None else None

        except Exception:
            with self.lock:
                self.last_error = traceback.format_exc()
        finally:
            try:
                if pipeline is not None:
                    pipeline.stop()
            except Exception:
                pass
            self.running = False


# -----------------------------------------------------------------------------
# Component execution
# -----------------------------------------------------------------------------

enable_stream = bool(_g("enable_stream", False))
sensor_name = _safe_name(_g("sensor_name", "camera1"), "camera1")
serial = str(_g("serial", "") or "").strip()
width = _to_int(_g("width", 640), 640)
height = _to_int(_g("height", 480), 480)
fps = _to_int(_g("fps", 30), 30)
use_depth = bool(_g("use_depth", True))
align_depth = bool(_g("align_depth", True))
apply_filters = bool(_g("apply_filters", False))
sample_rate_hz = _to_float(_g("sample_rate_hz", 0.0), 0.0)
preview_every_n = _to_int(_g("preview_every_n", 5), 5)
reset = bool(_g("reset", False))

# Basic guardrails.
width = max(160, int(width))
height = max(120, int(height))
fps = max(1, int(fps))
preview_every_n = max(1, int(preview_every_n))

key = _component_key(sensor_name)
state = sc.sticky.get(key)
if state is None:
    state = RealSenseRGBDStreamerState(sensor_name)
    sc.sticky[key] = state

if reset:
    state.reset()

config = {
    "sensor_name": sensor_name,
    "serial": serial,
    "width": width,
    "height": height,
    "fps": fps,
    "use_depth": use_depth,
    "align_depth": align_depth,
    "apply_filters": apply_filters,
    "sample_rate_hz": sample_rate_hz,
    "preview_every_n": preview_every_n,
}

if enable_stream:
    state.start(config)
else:
    # This stops only when user disables the camera stream. Recorder toggles do not affect it.
    state.stop()

_img_pkt, _dep_pkt, _pimg, _pdep, _fc, _dc, _err, _running, _cfg = state.get_outputs()

image_packet = _img_pkt
image_t_ns = int(_img_pkt.get("t_ns", 0)) if isinstance(_img_pkt, dict) else 0
depth_packet = _dep_pkt
depth_t_ns = int(_dep_pkt.get("t_ns", 0)) if isinstance(_dep_pkt, dict) else 0
preview_image = _pimg
preview_depth = _pdep
frame_count = int(_fc)
dropped_count = int(_dc)

if _err:
    status = "ERROR in {}: {}".format(sensor_name, _err[-500:])
elif enable_stream and _running:
    status = "Streaming {} | {}x{}@{} | frames={} | depth={} | align={} | filters={}".format(
        sensor_name, width, height, fps, frame_count, use_depth, align_depth, apply_filters
    )
elif enable_stream and not _running:
    status = "Starting {} ... If this stays, check pyrealsense2/camera connection.".format(sensor_name)
else:
    status = "Stopped {}. Enable stream to start camera. Recorder toggles do not control this component.".format(sensor_name)
# ---------- end dp_rs_stream ----------

# ----
# Realsense Pointcloud: img
toggle_3 = BooleanToggle(False)
# System Time
# Params provided to user:
# 
# 1. a single button to start
# 2. select the number of sensors labels with the following type:
# 
# 
# 3. output directory
trigger = Trigger(Interval=50, TimerInterval=50, Target=realsense_livestream_img)  # disabled
realsense_livestream_img = Python3Script(Run=toggle_3, Reset=Toggle(False))  # -> out, status, depth_frame, color_frame, timestamp
# ---------- realsense_livestream_img: Python ----------
# r: pyrealsense2, numpy
import pyrealsense2 as rs
import numpy as np
import scriptcontext as sc
import Rhino
import System
import time
from System.Drawing import Bitmap
from System.Drawing.Imaging import PixelFormat

# Initialize output parameters
status = "Inactive"
Img = None

# --- Viewport HUD Overlay Setup ---
class LiveFeedConduit(Rhino.Display.DisplayConduit):
    def __init__(self):
        super().__init__()
        self.disp_bmp = None
        
    def update_image(self, sys_bitmap):
        if self.disp_bmp:
            self.disp_bmp.Dispose()
        self.disp_bmp = Rhino.Display.DisplayBitmap(sys_bitmap)
        
    def DrawForeground(self, e):
        if self.disp_bmp:
            e.Display.DrawBitmap(self.disp_bmp, 10, 10)
            
    def Clear(self):
        if self.disp_bmp:
            self.disp_bmp.Dispose()
            self.disp_bmp = None

def start_realsense():
    pipe = rs.pipeline()
    config = rs.config()
    config.enable_stream(rs.stream.color, 640, 480, rs.format.bgr8, 30)
    config.enable_stream(rs.stream.depth, 640, 480, rs.format.z16, 30)
    pipe.start(config)
    return pipe

def close_everything():
    if 'rs_pipeline' in sc.sticky:
        try:
            sc.sticky['rs_pipeline'].stop()
        except: pass
        del sc.sticky['rs_pipeline']
        
    if 'rs_conduit' in sc.sticky:
        try:
            sc.sticky['rs_conduit'].Enabled = False
            sc.sticky['rs_conduit'].Clear()
        except: pass
        del sc.sticky['rs_conduit']

# --- Execution Logic ---

if Reset or not Run:
    close_everything()
    Rhino.RhinoDoc.ActiveDoc.Views.Redraw()
    status = "Pipeline and HUD stopped clean."

if Run:
    if 'rs_conduit' not in sc.sticky:
        sc.sticky['rs_conduit'] = LiveFeedConduit()
        sc.sticky['rs_conduit'].Enabled = True
    conduit = sc.sticky['rs_conduit']
    
    if 'rs_pipeline' not in sc.sticky:
        try:
            sc.sticky['rs_pipeline'] = start_realsense()
            status = "Warming up camera..."
        except Exception as e:
            status = f"Init Error: {e}"
            Run = False
            
    if 'rs_pipeline' in sc.sticky:
        pipeline = sc.sticky['rs_pipeline']
        try:
            frames = pipeline.wait_for_frames(timeout_ms=200)
            color_frame = frames.get_color_frame()
            depth_frame = frames.get_depth_frame()
            
            if color_frame:
                color_image = np.asanyarray(color_frame.get_data())
                
                # Get array dimensions
                height, width, channels = color_image.shape
                stride = width * channels # Bytes per row
                
                # Grab the memory pointer of the raw NumPy array 
                ptr = System.IntPtr(color_image.__array_interface__['data'][0])
                
                # Instantly map the pointer to a .NET Bitmap (No encoding overhead!)
                temp_bmp = Bitmap(width, height, stride, PixelFormat.Format24bppRgb, ptr)
                
                # Create a deep copy so Grasshopper/Rhino safely own the pixels
                Img = Bitmap(temp_bmp)
                
                # Update Viewport Overlay HUD
                conduit.update_image(Img)
                
                # Free the pointer wrapper immediately
                temp_bmp.Dispose()
                
                Rhino.RhinoDoc.ActiveDoc.Views.Redraw()
                status = "Live Stream active inside Rhino & GH!"
                
        except Exception as e:
            status = f"Capture Error: {e}"
# ---------- end realsense_livestream_img ----------
panel_4 = Panel(realsense_livestream_img.status)

panel_5 = Panel(dp_rs_stream.Status)
episode_dir = ListItem(List=py3_2.a, Index=Slider(2, range=0..10), Wrap=True)

# ----
# Image recorder
panel_6 = Panel("camera1_image")
dp_imagerec = DP01ImageRecorder(Sensor=panel_6, Packet=dp_rs_stream.ImagePacket, Timestamp=dp_rs_stream.ImageT)  # -> Status, Frames, Dropped, SensorDir, LastT, LastFile
# ---------- dp_imagerec: Python ----------
"""
Grasshopper Python 3 component: DP 01 Image Recorder
====================================================
Purpose
-------
Independent image recorder for one RGB camera stream. It does not depend on
MOCAP or other cameras. Each saved image has a row in timestamps.csv with a
canonical t_ns value. Later, pair this stream with MOCAP/depth/other cameras by
nearest t_ns, similar to ROS message_filters ApproximateTime.

Create these Grasshopper inputs, in this exact order:
    0 record          bool    From DP 00 Episode Controller output: record.
    1 episode_dir     str     From DP 00 Episode Controller output: episode_dir.
    2 sensor_name     str     Folder name, e.g. camera1_image or wrist_camera_image.
    3 image_packet    object  Preferred. Dict/object with image/color/rgb and optional t_ns.
    4 image           object  Optional raw image if you do not use image_packet.
    5 t_ns            object  Optional int timestamp for raw image. Empty => assigned here.
    6 enabled         bool    Set True during normal use.
    7 image_format    str     jpg or png. Default jpg.
    8 jpeg_quality    int     1-100. Default 90.
    9 min_period_ms   float   Optional throttle. 0 records every new packet.
    10 reset          bool    Momentary button. Clears this recorder state.

Create these Grasshopper outputs, in this exact order:
    0 status          str     Human-readable status.
    1 frame_count     int     Frames accepted in current/last episode.
    2 dropped_count   int     Frames dropped because writer queue was full.
    3 sensor_dir      str     Folder path for this sensor.
    4 last_t_ns       int     Last saved timestamp.
    5 last_filename   str     Last saved image filename.

Expected packet formats:
    Dict examples:
        {"t_ns": 123, "image": np_rgb_uint8}
        {"t_ns": 123, "color": np_rgb_uint8}
        {"t_ns": 123, "rgb": np_rgb_uint8}
    Object examples:
        packet.t_ns + packet.color
        packet.t_ns + packet.image

Saved format:
    episode_001/
        camera1_image/
            frames/
                frame_000001.jpg
                frame_000002.jpg
            timestamps.csv
            sensor_meta.json

CSV columns:
    seq,t_ns,wall_time_ns,filename,width,height,channels,format

Timestamp convention:
    t_ns = int64 time.perf_counter_ns() from the same Rhino Python process.
    It is monotonic and mutually referable across recorders in the same process.
"""

import os
import csv
import time
import json
import queue
import threading
import traceback
import scriptcontext as sc

# -----------------------------------------------------------------------------
# Grasshopper UI annotation
# -----------------------------------------------------------------------------

def _annotate_gh_component():
    try:
        comp = ghenv.Component
        comp.Name = "DP 01 Image Recorder"
        comp.NickName = "DP_ImageRec"
        comp.Description = "Independent timestamped RGB image recorder. Saves frames + timestamps.csv."
        input_specs = [
            ("record", "Record", "Record bool from Episode Controller."),
            ("episode_dir", "EpisodeDir", "Episode folder path from Episode Controller."),
            ("sensor_name", "Sensor", "Folder name, e.g. camera1_image."),
            ("image_packet", "Packet", "Preferred: dict/object containing image/color/rgb and optional t_ns."),
            ("image", "Image", "Optional raw image if no packet is used."),
            ("t_ns", "Timestamp", "Optional int timestamp for raw image. Empty = assign now."),
            ("enabled", "Enabled", "Enable this recorder."),
            ("image_format", "Format", "jpg or png. Default jpg."),
            ("jpeg_quality", "JPGQuality", "JPEG quality 1-100. Default 90."),
            ("min_period_ms", "MinPeriod", "Optional throttle in ms. 0 = record every new packet."),
            ("reset", "Reset", "Momentary button. Reset this recorder state."),
        ]
        output_specs = [
            ("status", "Status", "Human-readable status."),
            ("frame_count", "Frames", "Frames accepted in current/last episode."),
            ("dropped_count", "Dropped", "Frames dropped due to full writer queue."),
            ("sensor_dir", "SensorDir", "This sensor folder path."),
            ("last_t_ns", "LastT", "Last saved timestamp."),
            ("last_filename", "LastFile", "Last saved filename."),
        ]
        for i, spec in enumerate(input_specs):
            if i < comp.Params.Input.Count:
                comp.Params.Input[i].Name = spec[0]
                comp.Params.Input[i].NickName = spec[1]
                comp.Params.Input[i].Description = spec[2]
        for i, spec in enumerate(output_specs):
            if i < comp.Params.Output.Count:
                comp.Params.Output[i].Name = spec[0]
                comp.Params.Output[i].NickName = spec[1]
                comp.Params.Output[i].Description = spec[2]
    except Exception:
        pass

_annotate_gh_component()

# -----------------------------------------------------------------------------
# Helpers
# -----------------------------------------------------------------------------

def _g(name, default=None):
    return globals().get(name, default)


def _safe_name(text, fallback="image_sensor"):
    text = str(text or "").strip() or fallback
    return "".join(ch if (ch.isalnum() or ch in ["_", "-", "."]) else "_" for ch in text)


def _component_key(sensor):
    try:
        return "DP_IMAGE_RECORDER_{}_{}".format(ghenv.Component.InstanceGuid, sensor)
    except Exception:
        return "DP_IMAGE_RECORDER_DEFAULT_{}".format(sensor)


def _packet_get(packet, names, default=None):
    if packet is None:
        return default
    if isinstance(packet, dict):
        for n in names:
            if n in packet:
                return packet[n]
    for n in names:
        if hasattr(packet, n):
            return getattr(packet, n)
    return default


def _shape_of_image(arr):
    try:
        shape = arr.shape
        if len(shape) == 2:
            return int(shape[1]), int(shape[0]), 1
        if len(shape) == 3:
            return int(shape[1]), int(shape[0]), int(shape[2])
    except Exception:
        pass
    return 0, 0, 0


def _save_rgb_image(path, arr, image_format="jpg", jpeg_quality=90):
    """Save RGB uint8 HWC image. Uses cv2 if available, then PIL, then .npy fallback."""
    fmt = (image_format or "jpg").lower().strip().replace("jpeg", "jpg")
    try:
        import numpy as np
        a = np.asarray(arr)
        if a.ndim == 2:
            pass
        elif a.ndim == 3 and a.shape[2] >= 3:
            a = a[:, :, :3]
        else:
            raise ValueError("Unsupported image shape {}".format(a.shape))
    except Exception:
        raise

    # Try OpenCV first.
    try:
        import cv2
        if a.ndim == 3 and a.shape[2] == 3:
            bgr = cv2.cvtColor(a, cv2.COLOR_RGB2BGR)
        else:
            bgr = a
        if fmt == "jpg":
            ok = cv2.imwrite(path, bgr, [int(cv2.IMWRITE_JPEG_QUALITY), int(jpeg_quality)])
        else:
            ok = cv2.imwrite(path, bgr)
        if not ok:
            raise RuntimeError("cv2.imwrite returned False")
        return path
    except Exception:
        pass

    # Fallback to Pillow.
    try:
        from PIL import Image
        im = Image.fromarray(a)
        if fmt == "jpg":
            im.save(path, quality=int(jpeg_quality))
        else:
            im.save(path)
        return path
    except Exception:
        pass

    # Last fallback: save npy next to requested path.
    import numpy as np
    npy_path = os.path.splitext(path)[0] + ".npy"
    np.save(npy_path, a)
    return npy_path


# -----------------------------------------------------------------------------
# Writer class
# -----------------------------------------------------------------------------

class ImageRecorderState(object):
    def __init__(self, sensor_name):
        self.sensor_name = sensor_name
        self.prev_record = False
        self.active = False
        self.sensor_dir = ""
        self.frames_dir = ""
        self.csv_path = ""
        self.meta_path = ""
        self.q = None
        self.thread = None
        self.stop_token = object()
        self.frame_count = 0
        self.dropped_count = 0
        self.last_t_ns = 0
        self.last_filename = ""
        self.last_seen_t_ns = None
        self.last_recorded_t_ns = None
        self.last_error = ""
        self.image_format = "jpg"
        self.jpeg_quality = 90
        self.started_wall_time_ns = None
        self.started_perf_counter_ns = None

    def reset(self):
        self.close()
        self.prev_record = False
        self.frame_count = 0
        self.dropped_count = 0
        self.last_t_ns = 0
        self.last_filename = ""
        self.last_seen_t_ns = None
        self.last_recorded_t_ns = None
        self.last_error = ""

    def open(self, episode_dir, image_format="jpg", jpeg_quality=90):
        self.close()
        self.image_format = (image_format or "jpg").lower().strip().replace("jpeg", "jpg")
        if self.image_format not in ["jpg", "png"]:
            self.image_format = "jpg"
        self.jpeg_quality = int(jpeg_quality or 90)
        self.sensor_dir = os.path.join(episode_dir, self.sensor_name)
        self.frames_dir = os.path.join(self.sensor_dir, "frames")
        os.makedirs(self.frames_dir, exist_ok=True)
        self.csv_path = os.path.join(self.sensor_dir, "timestamps.csv")
        self.meta_path = os.path.join(self.sensor_dir, "sensor_meta.json")
        self.q = queue.Queue(maxsize=64)
        self.frame_count = 0
        self.dropped_count = 0
        self.last_t_ns = 0
        self.last_filename = ""
        self.last_seen_t_ns = None
        self.last_recorded_t_ns = None
        self.last_error = ""
        self.started_wall_time_ns = time.time_ns()
        self.started_perf_counter_ns = time.perf_counter_ns()
        self.active = True
        self.thread = threading.Thread(target=self._writer_loop, daemon=True)
        self.thread.start()

        meta = {
            "sensor_name": self.sensor_name,
            "sensor_type": "rgb_image",
            "image_format": self.image_format,
            "jpeg_quality": self.jpeg_quality,
            "timestamp_column": "t_ns",
            "timestamp_convention": "time.perf_counter_ns(), int64 nanoseconds, monotonic in Rhino Python process",
            "started_wall_time_ns": int(self.started_wall_time_ns),
            "started_perf_counter_ns": int(self.started_perf_counter_ns),
            "csv_columns": ["seq", "t_ns", "wall_time_ns", "filename", "width", "height", "channels", "format"]
        }
        with open(self.meta_path, "w") as f:
            json.dump(meta, f, indent=2)

    def close(self):
        if self.active and self.q is not None:
            try:
                self.q.put(self.stop_token, timeout=1.0)
            except Exception:
                pass
            try:
                if self.thread is not None:
                    self.thread.join(timeout=3.0)
            except Exception:
                pass
        self.active = False
        self.q = None
        self.thread = None
        if self.meta_path:
            try:
                with open(self.meta_path, "r") as f:
                    meta = json.load(f)
            except Exception:
                meta = {}
            meta.update({
                "stopped_wall_time_ns": int(time.time_ns()),
                "stopped_perf_counter_ns": int(time.perf_counter_ns()),
                "frame_count": int(self.frame_count),
                "dropped_count": int(self.dropped_count),
                "last_t_ns": int(self.last_t_ns or 0),
                "last_filename": self.last_filename,
                "last_error": self.last_error
            })
            try:
                with open(self.meta_path, "w") as f:
                    json.dump(meta, f, indent=2)
            except Exception:
                pass

    def enqueue(self, img, t_ns, min_period_ms=0.0):
        if not self.active or self.q is None or img is None:
            return False
        t_ns = int(t_ns)
        if self.last_seen_t_ns == t_ns:
            return False
        self.last_seen_t_ns = t_ns

        if self.last_recorded_t_ns is not None and float(min_period_ms or 0.0) > 0.0:
            if (t_ns - self.last_recorded_t_ns) < int(float(min_period_ms) * 1e6):
                return False

        seq = self.frame_count + self.dropped_count + 1
        ext = "jpg" if self.image_format == "jpg" else "png"
        filename = "frame_{:06d}.{}".format(seq, ext)
        width, height, channels = _shape_of_image(img)
        item = {
            "seq": seq,
            "t_ns": t_ns,
            "wall_time_ns": int(time.time_ns()),
            "filename": filename,
            "width": width,
            "height": height,
            "channels": channels,
            "format": self.image_format,
            "image": img,
        }
        try:
            self.q.put_nowait(item)
            self.last_recorded_t_ns = t_ns
            return True
        except queue.Full:
            self.dropped_count += 1
            return False

    def _writer_loop(self):
        try:
            with open(self.csv_path, "w", newline="") as f:
                writer = csv.DictWriter(
                    f,
                    fieldnames=["seq", "t_ns", "wall_time_ns", "filename", "width", "height", "channels", "format"]
                )
                writer.writeheader()
                while True:
                    item = self.q.get()
                    if item is self.stop_token:
                        break
                    try:
                        img = item.pop("image")
                        out_path = os.path.join(self.frames_dir, item["filename"])
                        actual_path = _save_rgb_image(out_path, img, self.image_format, self.jpeg_quality)
                        if os.path.basename(actual_path) != item["filename"]:
                            item["filename"] = os.path.basename(actual_path)
                            item["format"] = os.path.splitext(actual_path)[1].lstrip(".")
                        writer.writerow(item)
                        self.frame_count += 1
                        self.last_t_ns = int(item["t_ns"])
                        self.last_filename = item["filename"]
                        if self.frame_count % 10 == 0:
                            f.flush()
                    except Exception as e:
                        self.last_error = str(e)
                f.flush()
        except Exception:
            self.last_error = traceback.format_exc()


# -----------------------------------------------------------------------------
# Component execution
# -----------------------------------------------------------------------------

record = bool(_g("record", False))
episode_dir = str(_g("episode_dir", "") or "").strip()
sensor_name = _safe_name(_g("sensor_name", "camera_image"), "camera_image")
image_packet = _g("image_packet", None)
raw_image = _g("image", None)
input_t_ns = _g("t_ns", None)
enabled = bool(_g("enabled", True))
image_format = str(_g("image_format", "jpg") or "jpg")
jpeg_quality = int(_g("jpeg_quality", 90) or 90)
min_period_ms = float(_g("min_period_ms", 0.0) or 0.0)
reset = bool(_g("reset", False))

key = _component_key(sensor_name)
state = sc.sticky.get(key)
if state is None:
    state = ImageRecorderState(sensor_name)
    sc.sticky[key] = state

if reset:
    state.reset()

# Extract packet image + timestamp. Timestamp is assigned at recorder arrival if missing.
img = _packet_get(image_packet, ["image", "color", "rgb", "frame"], None)
if img is None:
    img = raw_image

pkt_t = _packet_get(image_packet, ["t_ns", "timestamp_ns", "time_ns"], None)
if pkt_t is None:
    pkt_t = input_t_ns
try:
    pkt_t = int(pkt_t) if pkt_t is not None and str(pkt_t) != "" else int(time.perf_counter_ns())
except Exception:
    pkt_t = int(time.perf_counter_ns())

rising_edge = record and not state.prev_record
falling_edge = (not record) and state.prev_record

if not enabled:
    status = "Disabled."
else:
    if rising_edge:
        if episode_dir:
            state.open(episode_dir, image_format=image_format, jpeg_quality=jpeg_quality)
            status = "Started {}".format(sensor_name)
        else:
            status = "Cannot start: episode_dir is empty."
    elif falling_edge:
        state.close()
        status = "Stopped {}. Saved {} frames.".format(sensor_name, state.frame_count)
    elif record and state.active:
        accepted = state.enqueue(img, pkt_t, min_period_ms=min_period_ms)
        status = "Recording {} | frames={} dropped={}{}".format(
            sensor_name,
            state.frame_count,
            state.dropped_count,
            "" if accepted else " | no new frame"
        )
    elif record and not state.active:
        # Safety: if a component was enabled after episode start, open immediately.
        if episode_dir:
            state.open(episode_dir, image_format=image_format, jpeg_quality=jpeg_quality)
            status = "Late-started {}".format(sensor_name)
        else:
            status = "Waiting for episode_dir."
    else:
        status = "Ready: {}".format(sensor_name)

state.prev_record = record

frame_count = int(state.frame_count)
dropped_count = int(state.dropped_count)
sensor_dir = state.sensor_dir
last_t_ns = int(state.last_t_ns or 0)
last_filename = state.last_filename
if state.last_error:
    status = status + " | ERROR: " + state.last_error[-200:]
# ---------- end dp_imagerec ----------

# ----
# Depth Image recorder
dp_depthrec = DP02DepthImageRecorder()  # -> Status, Frames, Dropped, SensorDir, LastT, LastFile
# ---------- dp_depthrec: Python ----------
"""
Grasshopper Python 3 component: DP 02 Depth Image Recorder
==========================================================
Purpose
-------
Independent aligned/raw depth recorder for one depth stream. It does not depend
on image or MOCAP recorders. Each saved depth image has a row in timestamps.csv.
Pair later with RGB/MOCAP by nearest t_ns.

Create these Grasshopper inputs, in this exact order:
    0 record          bool    From DP 00 Episode Controller output: record.
    1 episode_dir     str     From DP 00 Episode Controller output: episode_dir.
    2 sensor_name     str     Folder name, e.g. camera1_aligned_depth.
    3 depth_packet    object  Preferred. Dict/object with depth/aligned_depth and optional t_ns.
    4 depth_image     object  Optional raw depth array if no packet is used.
    5 t_ns            object  Optional int timestamp for raw depth. Empty => assigned here.
    6 enabled         bool    Set True during normal use.
    7 depth_format    str     png or npy. Default png. PNG is uint16 lossless if possible.
    8 depth_scale     float   Optional meters per depth unit, e.g. 0.001 for RealSense mm. Stored in metadata.
    9 min_period_ms   float   Optional throttle. 0 records every new packet.
    10 reset          bool    Momentary button. Clears this recorder state.

Create these Grasshopper outputs, in this exact order:
    0 status          str     Human-readable status.
    1 frame_count     int     Frames accepted in current/last episode.
    2 dropped_count   int     Frames dropped because writer queue was full.
    3 sensor_dir      str     Folder path for this sensor.
    4 last_t_ns       int     Last saved timestamp.
    5 last_filename   str     Last saved depth filename.

Saved format:
    episode_001/
        camera1_aligned_depth/
            frames/
                depth_000001.png   # uint16 if input is uint16/int depth
                depth_000002.png
            timestamps.csv
            sensor_meta.json

CSV columns:
    seq,t_ns,wall_time_ns,filename,width,height,dtype,format

Timestamp convention:
    t_ns = int64 time.perf_counter_ns() from the same Rhino Python process.
"""

import os
import csv
import time
import json
import queue
import threading
import traceback
import scriptcontext as sc

# -----------------------------------------------------------------------------
# Grasshopper UI annotation
# -----------------------------------------------------------------------------

def _annotate_gh_component():
    try:
        comp = ghenv.Component
        comp.Name = "DP 02 Depth Image Recorder"
        comp.NickName = "DP_DepthRec"
        comp.Description = "Independent timestamped depth recorder. Saves depth frames + timestamps.csv."
        input_specs = [
            ("record", "Record", "Record bool from Episode Controller."),
            ("episode_dir", "EpisodeDir", "Episode folder path from Episode Controller."),
            ("sensor_name", "Sensor", "Folder name, e.g. camera1_aligned_depth."),
            ("depth_packet", "Packet", "Preferred: dict/object containing depth/aligned_depth and optional t_ns."),
            ("depth_image", "Depth", "Optional raw depth array if no packet is used."),
            ("t_ns", "Timestamp", "Optional int timestamp for raw depth. Empty = assign now."),
            ("enabled", "Enabled", "Enable this recorder."),
            ("depth_format", "Format", "png or npy. Default png."),
            ("depth_scale", "DepthScale", "Meters per depth unit. Stored only as metadata."),
            ("min_period_ms", "MinPeriod", "Optional throttle in ms. 0 = record every new packet."),
            ("reset", "Reset", "Momentary button. Reset this recorder state."),
        ]
        output_specs = [
            ("status", "Status", "Human-readable status."),
            ("frame_count", "Frames", "Frames accepted in current/last episode."),
            ("dropped_count", "Dropped", "Frames dropped due to full writer queue."),
            ("sensor_dir", "SensorDir", "This sensor folder path."),
            ("last_t_ns", "LastT", "Last saved timestamp."),
            ("last_filename", "LastFile", "Last saved filename."),
        ]
        for i, spec in enumerate(input_specs):
            if i < comp.Params.Input.Count:
                comp.Params.Input[i].Name = spec[0]
                comp.Params.Input[i].NickName = spec[1]
                comp.Params.Input[i].Description = spec[2]
        for i, spec in enumerate(output_specs):
            if i < comp.Params.Output.Count:
                comp.Params.Output[i].Name = spec[0]
                comp.Params.Output[i].NickName = spec[1]
                comp.Params.Output[i].Description = spec[2]
    except Exception:
        pass

_annotate_gh_component()

# -----------------------------------------------------------------------------
# Helpers
# -----------------------------------------------------------------------------

def _g(name, default=None):
    return globals().get(name, default)


def _safe_name(text, fallback="depth_sensor"):
    text = str(text or "").strip() or fallback
    return "".join(ch if (ch.isalnum() or ch in ["_", "-", "."]) else "_" for ch in text)


def _component_key(sensor):
    try:
        return "DP_DEPTH_RECORDER_{}_{}".format(ghenv.Component.InstanceGuid, sensor)
    except Exception:
        return "DP_DEPTH_RECORDER_DEFAULT_{}".format(sensor)


def _packet_get(packet, names, default=None):
    if packet is None:
        return default
    if isinstance(packet, dict):
        for n in names:
            if n in packet:
                return packet[n]
    for n in names:
        if hasattr(packet, n):
            return getattr(packet, n)
    return default


def _depth_shape_dtype(arr):
    try:
        import numpy as np
        a = np.asarray(arr)
        if a.ndim == 2:
            return int(a.shape[1]), int(a.shape[0]), str(a.dtype)
        if a.ndim == 3:
            return int(a.shape[1]), int(a.shape[0]), str(a.dtype)
    except Exception:
        pass
    return 0, 0, "unknown"


def _save_depth(path, arr, depth_format="png"):
    fmt = (depth_format or "png").lower().strip()
    import numpy as np
    a = np.asarray(arr)

    if fmt == "npy":
        np.save(path, a)
        return path

    # For PNG, prefer uint16 for RealSense-style depth.
    if a.dtype not in [np.uint16, np.uint8]:
        # Preserve values reasonably: if float, store as npy fallback to avoid silent quantization.
        npy_path = os.path.splitext(path)[0] + ".npy"
        np.save(npy_path, a)
        return npy_path

    try:
        import cv2
        ok = cv2.imwrite(path, a)
        if not ok:
            raise RuntimeError("cv2.imwrite returned False")
        return path
    except Exception:
        pass

    try:
        from PIL import Image
        if a.dtype == np.uint16:
            im = Image.fromarray(a, mode="I;16")
        else:
            im = Image.fromarray(a)
        im.save(path)
        return path
    except Exception:
        pass

    npy_path = os.path.splitext(path)[0] + ".npy"
    np.save(npy_path, a)
    return npy_path


# -----------------------------------------------------------------------------
# Writer class
# -----------------------------------------------------------------------------

class DepthRecorderState(object):
    def __init__(self, sensor_name):
        self.sensor_name = sensor_name
        self.prev_record = False
        self.active = False
        self.sensor_dir = ""
        self.frames_dir = ""
        self.csv_path = ""
        self.meta_path = ""
        self.q = None
        self.thread = None
        self.stop_token = object()
        self.frame_count = 0
        self.dropped_count = 0
        self.last_t_ns = 0
        self.last_filename = ""
        self.last_seen_t_ns = None
        self.last_recorded_t_ns = None
        self.last_error = ""
        self.depth_format = "png"
        self.depth_scale = None

    def reset(self):
        self.close()
        self.prev_record = False
        self.frame_count = 0
        self.dropped_count = 0
        self.last_t_ns = 0
        self.last_filename = ""
        self.last_seen_t_ns = None
        self.last_recorded_t_ns = None
        self.last_error = ""

    def open(self, episode_dir, depth_format="png", depth_scale=None):
        self.close()
        self.depth_format = (depth_format or "png").lower().strip()
        if self.depth_format not in ["png", "npy"]:
            self.depth_format = "png"
        self.depth_scale = depth_scale
        self.sensor_dir = os.path.join(episode_dir, self.sensor_name)
        self.frames_dir = os.path.join(self.sensor_dir, "frames")
        os.makedirs(self.frames_dir, exist_ok=True)
        self.csv_path = os.path.join(self.sensor_dir, "timestamps.csv")
        self.meta_path = os.path.join(self.sensor_dir, "sensor_meta.json")
        self.q = queue.Queue(maxsize=64)
        self.frame_count = 0
        self.dropped_count = 0
        self.last_t_ns = 0
        self.last_filename = ""
        self.last_seen_t_ns = None
        self.last_recorded_t_ns = None
        self.last_error = ""
        self.active = True
        self.thread = threading.Thread(target=self._writer_loop, daemon=True)
        self.thread.start()

        meta = {
            "sensor_name": self.sensor_name,
            "sensor_type": "depth_image",
            "depth_format": self.depth_format,
            "depth_scale": self.depth_scale,
            "timestamp_column": "t_ns",
            "timestamp_convention": "time.perf_counter_ns(), int64 nanoseconds, monotonic in Rhino Python process",
            "started_wall_time_ns": int(time.time_ns()),
            "started_perf_counter_ns": int(time.perf_counter_ns()),
            "csv_columns": ["seq", "t_ns", "wall_time_ns", "filename", "width", "height", "dtype", "format"]
        }
        with open(self.meta_path, "w") as f:
            json.dump(meta, f, indent=2)

    def close(self):
        if self.active and self.q is not None:
            try:
                self.q.put(self.stop_token, timeout=1.0)
            except Exception:
                pass
            try:
                if self.thread is not None:
                    self.thread.join(timeout=3.0)
            except Exception:
                pass
        self.active = False
        self.q = None
        self.thread = None
        if self.meta_path:
            try:
                with open(self.meta_path, "r") as f:
                    meta = json.load(f)
            except Exception:
                meta = {}
            meta.update({
                "stopped_wall_time_ns": int(time.time_ns()),
                "stopped_perf_counter_ns": int(time.perf_counter_ns()),
                "frame_count": int(self.frame_count),
                "dropped_count": int(self.dropped_count),
                "last_t_ns": int(self.last_t_ns or 0),
                "last_filename": self.last_filename,
                "last_error": self.last_error
            })
            try:
                with open(self.meta_path, "w") as f:
                    json.dump(meta, f, indent=2)
            except Exception:
                pass

    def enqueue(self, depth, t_ns, min_period_ms=0.0):
        if not self.active or self.q is None or depth is None:
            return False
        t_ns = int(t_ns)
        if self.last_seen_t_ns == t_ns:
            return False
        self.last_seen_t_ns = t_ns

        if self.last_recorded_t_ns is not None and float(min_period_ms or 0.0) > 0.0:
            if (t_ns - self.last_recorded_t_ns) < int(float(min_period_ms) * 1e6):
                return False

        seq = self.frame_count + self.dropped_count + 1
        ext = "npy" if self.depth_format == "npy" else "png"
        filename = "depth_{:06d}.{}".format(seq, ext)
        width, height, dtype = _depth_shape_dtype(depth)
        item = {
            "seq": seq,
            "t_ns": t_ns,
            "wall_time_ns": int(time.time_ns()),
            "filename": filename,
            "width": width,
            "height": height,
            "dtype": dtype,
            "format": self.depth_format,
            "depth": depth,
        }
        try:
            self.q.put_nowait(item)
            self.last_recorded_t_ns = t_ns
            return True
        except queue.Full:
            self.dropped_count += 1
            return False

    def _writer_loop(self):
        try:
            with open(self.csv_path, "w", newline="") as f:
                writer = csv.DictWriter(
                    f,
                    fieldnames=["seq", "t_ns", "wall_time_ns", "filename", "width", "height", "dtype", "format"]
                )
                writer.writeheader()
                while True:
                    item = self.q.get()
                    if item is self.stop_token:
                        break
                    try:
                        depth = item.pop("depth")
                        out_path = os.path.join(self.frames_dir, item["filename"])
                        actual_path = _save_depth(out_path, depth, self.depth_format)
                        if os.path.basename(actual_path) != item["filename"]:
                            item["filename"] = os.path.basename(actual_path)
                            item["format"] = os.path.splitext(actual_path)[1].lstrip(".")
                        writer.writerow(item)
                        self.frame_count += 1
                        self.last_t_ns = int(item["t_ns"])
                        self.last_filename = item["filename"]
                        if self.frame_count % 10 == 0:
                            f.flush()
                    except Exception as e:
                        self.last_error = str(e)
                f.flush()
        except Exception:
            self.last_error = traceback.format_exc()


# -----------------------------------------------------------------------------
# Component execution
# -----------------------------------------------------------------------------

record = bool(_g("record", False))
episode_dir = str(_g("episode_dir", "") or "").strip()
sensor_name = _safe_name(_g("sensor_name", "camera_aligned_depth"), "camera_aligned_depth")
depth_packet = _g("depth_packet", None)
raw_depth = _g("depth_image", None)
input_t_ns = _g("t_ns", None)
enabled = bool(_g("enabled", True))
depth_format = str(_g("depth_format", "png") or "png")
depth_scale = _g("depth_scale", None)
min_period_ms = float(_g("min_period_ms", 0.0) or 0.0)
reset = bool(_g("reset", False))

key = _component_key(sensor_name)
state = sc.sticky.get(key)
if state is None:
    state = DepthRecorderState(sensor_name)
    sc.sticky[key] = state

if reset:
    state.reset()

depth = _packet_get(depth_packet, ["depth", "aligned_depth", "depth_image", "frame"], None)
if depth is None:
    depth = raw_depth

pkt_t = _packet_get(depth_packet, ["t_ns", "timestamp_ns", "time_ns"], None)
if pkt_t is None:
    pkt_t = input_t_ns
try:
    pkt_t = int(pkt_t) if pkt_t is not None and str(pkt_t) != "" else int(time.perf_counter_ns())
except Exception:
    pkt_t = int(time.perf_counter_ns())

rising_edge = record and not state.prev_record
falling_edge = (not record) and state.prev_record

if not enabled:
    status = "Disabled."
else:
    if rising_edge:
        if episode_dir:
            state.open(episode_dir, depth_format=depth_format, depth_scale=depth_scale)
            status = "Started {}".format(sensor_name)
        else:
            status = "Cannot start: episode_dir is empty."
    elif falling_edge:
        state.close()
        status = "Stopped {}. Saved {} frames.".format(sensor_name, state.frame_count)
    elif record and state.active:
        accepted = state.enqueue(depth, pkt_t, min_period_ms=min_period_ms)
        status = "Recording {} | frames={} dropped={}{}".format(
            sensor_name,
            state.frame_count,
            state.dropped_count,
            "" if accepted else " | no new depth"
        )
    elif record and not state.active:
        if episode_dir:
            state.open(episode_dir, depth_format=depth_format, depth_scale=depth_scale)
            status = "Late-started {}".format(sensor_name)
        else:
            status = "Waiting for episode_dir."
    else:
        status = "Ready: {}".format(sensor_name)

state.prev_record = record

frame_count = int(state.frame_count)
dropped_count = int(state.dropped_count)
sensor_dir = state.sensor_dir
last_t_ns = int(state.last_t_ns or 0)
last_filename = state.last_filename
if state.last_error:
    status = status + " | ERROR: " + state.last_error[-200:]
# ---------- end dp_depthrec ----------
# ----
# Realsense Depth camera: img / ptcloud
trigger_2 = Trigger(Interval=50, TimerInterval=50, Target=realsense_livestream)  # disabled
realsense_livestream = Python3Script(Run=Toggle(False), Reset=Button(), sampleStep=Slider(2, range=0..10))  # -> status, Img, color_frame, depth_frame, StartTime, ElapsedTime; inputs Run: Boolean, Reset: Boolean, sampleStep: Int32; disabled
# ---------- realsense_livestream: Python ----------
# r: pyrealsense2, numpy
import pyrealsense2 as rs
import numpy as np
import scriptcontext as sc
import Rhino
import System
import time
import datetime
from System.Drawing import Bitmap
from System.Drawing.Imaging import PixelFormat

"""
Component Setup
Update your Rhino 8 CPython component to have these exact inputs and outputs:

Inputs:
    Run (Boolean Toggle) — Starts/stops the stream.
    Reset (Boolean Button) — Resets the stream and zeroes out the timestamp tracker.
    SampleStep (Integer) — Slicing factor for point cloud density. A value of 1 pulls all pixels. A value of 4 samples every 4th pixel, dramatically speeding up downstream components.

Outputs:
    status — Stream status logs.
    Img — Active color frame as a .NET Bitmap.
    StartTime — Absolute start earth timestamp string recorded exactly once upon stream initiation.
    ElapsedTime — High-precision elapsed time in seconds since the start time.
    PointCloud — A flat list of raw Rhino.Geometry.Point3d coordinates from the depth map.
"""

# Initialize output parameters safely
status = "Inactive"
Img = None
StartTime = "None"
ElapsedTime = 0.0
PointCloud = []

# Guard for SampleStep input (Default to sampling every 4th element for performance)
step = int(SampleStep) if ('SampleStep' in globals() and SampleStep is not None and SampleStep >= 1) else 4

# --- Viewport HUD Overlay Setup ---
class LiveFeedConduit(Rhino.Display.DisplayConduit):
    def __init__(self):
        super().__init__()
        self.disp_bmp = None
        
    def update_image(self, sys_bitmap):
        if self.disp_bmp:
            self.disp_bmp.Dispose()
        self.disp_bmp = Rhino.Display.DisplayBitmap(sys_bitmap)
        
    def DrawForeground(self, e):
        if self.disp_bmp:
            e.Display.DrawBitmap(self.disp_bmp, 10, 10)
            
    def Clear(self):
        if self.disp_bmp:
            self.disp_bmp.Dispose()
            self.disp_bmp = None

def start_realsense():
    pipe = rs.pipeline()
    config = rs.config()
    # Enable both Color and Depth streams at 640x480 resolution
    config.enable_stream(rs.stream.color, 640, 480, rs.format.bgr8, 30)
    config.enable_stream(rs.stream.depth, 640, 480, rs.format.z16, 30)
    pipe.start(config)
    return pipe

def close_everything():
    if 'rs_pipeline' in sc.sticky:
        try:
            sc.sticky['rs_pipeline'].stop()
        except: pass
        del sc.sticky['rs_pipeline']
        
    if 'rs_conduit' in sc.sticky:
        try:
            sc.sticky['rs_conduit'].Enabled = False
            sc.sticky['rs_conduit'].Clear()
        except: pass
        del sc.sticky['rs_conduit']
        
    if 'rs_pc' in sc.sticky:
        del sc.sticky['rs_pc']
        
    if 'rs_start_time_str' in sc.sticky:
        del sc.sticky['rs_start_time_str']
        
    if 'rs_start_perf' in sc.sticky:
        del sc.sticky['rs_start_perf']

# --- Execution Logic ---

if Reset or not Run:
    close_everything()
    Rhino.RhinoDoc.ActiveDoc.Views.Redraw()
    status = "Pipeline, HUD, and time sessions stopped clean."

if Run:
    # 1. Initialize Viewport Overlays
    if 'rs_conduit' not in sc.sticky:
        sc.sticky['rs_conduit'] = LiveFeedConduit()
        sc.sticky['rs_conduit'].Enabled = True
    conduit = sc.sticky['rs_conduit']
    
    # 2. Initialize Camera and PointCloud context
    if 'rs_pipeline' not in sc.sticky:
        try:
            sc.sticky['rs_pipeline'] = start_realsense()
            sc.sticky['rs_pc'] = rs.pointcloud()
            
            # Record absolute start time matching standard mocap file headers
            now = datetime.datetime.now()
            sc.sticky['rs_start_time_str'] = now.strftime("%Y-%m-%d %I.%M.%S.%f")[:-3] + " " + now.strftime("%p")
            sc.sticky['rs_start_perf'] = time.perf_counter() # High-precision CPU counter
            
            status = "Warming up streams..."
        except Exception as e:
            status = f"Init Error: {e}"
            Run = False
            
    if 'rs_pipeline' in sc.sticky:
        pipeline = sc.sticky['rs_pipeline']
        pc = sc.sticky['rs_pc']
        
        # Pass the static session start time to the component output
        StartTime = sc.sticky.get('rs_start_time_str', "None")
        
        try:
            frames = pipeline.wait_for_frames(timeout_ms=200)
            color_frame = frames.get_color_frame()
            depth_frame = frames.get_depth_frame()
            
            # Calculate high-precision elapsed seconds (Mocap frame-time equivalent)
            ElapsedTime = time.perf_counter() - sc.sticky['rs_start_perf']
            
            # 3. Compute and format PointCloud data (passed raw downstream)
            if depth_frame:
                points = pc.calculate(depth_frame)
                vtx = np.asanyarray(points.get_vertices()).view(np.float32).reshape(-1, 3)
                
                # Spatial downsampling using fast numpy array slicing [::step]
                vtx_sampled = vtx[::step]
                
                # Filter out points with zero depth or out-of-bounds tracking (RealSense units are in meters)
                mask = (vtx_sampled[:, 2] > 0.01) & (vtx_sampled[:, 2] < 10.0)
                valid_points = vtx_sampled[mask]
                
                # Instantly map to native Rhino Geometry points
                PointCloud = [Rhino.Geometry.Point3d(float(p[0]), float(p[1]), float(p[2])) for p in valid_points]
            
            # 4. Handle Color Frame for Viewport Display
            if color_frame:
                color_image = np.asanyarray(color_frame.get_data())
                height, width, channels = color_image.shape
                stride = width * channels
                
                ptr = System.IntPtr(color_image.__array_interface__['data'][0])
                temp_bmp = Bitmap(width, height, stride, PixelFormat.Format24bppRgb, ptr)
                Img = Bitmap(temp_bmp)
                
                conduit.update_image(Img)
                temp_bmp.Dispose()
                
                Rhino.RhinoDoc.ActiveDoc.Views.Redraw()
                status = f"Streaming frame at {ElapsedTime:.4f}s. Contained Points: {len(PointCloud)}"
                
        except Exception as e:
            status = f"Capture Error: {e}"
# ---------- end realsense_livestream ----------
panel_7 = Panel(realsense_livestream.status)

trigger_3 = Trigger(Interval=50, TimerInterval=50, Target=py3_4)  # disabled

# ----
# MOCAP Opti-Track Streamer
# MOCAP_AssignTime
button = Button()
py3_3 = Python3Script(
    record=toggle_2,
    episode_dir=episode_dir,
    rigid_body_name=optitrack_stream.RBName,
    rb_plane=tracked_planes,
    enabled=toggle,
    reset=button)  # -> out, a
# ---------- py3_3: Python ----------
"""
Grasshopper Python 3 component: DP 03 MOCAP RB Plane Recorder (SDK Class Mode)
=============================================================================
Purpose
-------
Independent OptiTrack rigid-body Plane recorder optimized for Rhino 8's native
Python 3 engine layout. Retains state tracking cleanly across solutions.
"""

import System
import Rhino
import Grasshopper
import os
import csv
import time
import json
import math
import traceback

# -----------------------------------------------------------------------------
# Geometry and Helper Utilities
# -----------------------------------------------------------------------------

def _v3_to_tuple(v):
    return (float(v.X), float(v.Y), float(v.Z))


def _rotmat_to_rpy_zyx(R):
    """Return roll, pitch, yaw from 3x3 matrix using ZYX convention."""
    sy = math.sqrt(R[0][0] * R[0][0] + R[1][0] * R[1][0])
    singular = sy < 1e-8
    if not singular:
        roll = math.atan2(R[2][1], R[2][2])
        pitch = math.atan2(-R[2][0], sy)
        yaw = math.atan2(R[1][0], R[0][0])
    else:
        roll = math.atan2(-R[1][2], R[1][1])
        pitch = math.atan2(-R[2][0], sy)
        yaw = 0.0
    return roll, pitch, yaw


def _plane_to_row(plane, unit_scale=1.0, pose6_override=None):
    if plane is None and pose6_override is None:
        return None

    if plane is not None:
        ox, oy, oz = _v3_to_tuple(plane.Origin)
        xx, xy, xz = _v3_to_tuple(plane.XAxis)
        yx, yy, yz = _v3_to_tuple(plane.YAxis)
        zx, zy, zz = _v3_to_tuple(plane.ZAxis)

        # Matrix columns are local axes in world coordinates.
        R = [
            [xx, yx, zx],
            [xy, yy, zy],
            [xz, yz, zz],
        ]
        roll, pitch, yaw = _rotmat_to_rpy_zyx(R)
        x = ox * unit_scale
        y = oy * unit_scale
        z = oz * unit_scale
    else:
        # No full plane; only pose6 supplied.
        vals = [float(v) for v in pose6_override]
        x, y, z, roll, pitch, yaw = vals[:6]
        ox, oy, oz = x / unit_scale, y / unit_scale, z / unit_scale
        xx, xy, xz = 1.0, 0.0, 0.0
        yx, yy, yz = 0.0, 1.0, 0.0
        zx, zy, zz = 0.0, 0.0, 1.0

    if pose6_override is not None:
        vals = [float(v) for v in pose6_override]
        if len(vals) >= 6:
            x, y, z, roll, pitch, yaw = vals[:6]

    return {
        "x": float(x), "y": float(y), "z": float(z),
        "roll": float(roll), "pitch": float(pitch), "yaw": float(yaw),
        "origin_x": float(ox), "origin_y": float(oy), "origin_z": float(oz),
        "xaxis_x": float(xx), "xaxis_y": float(xy), "xaxis_z": float(xz),
        "yaxis_x": float(yx), "yaxis_y": float(yy), "yaxis_z": float(yz),
        "zaxis_x": float(zx), "zaxis_y": float(zy), "zaxis_z": float(zz),
    }


# -----------------------------------------------------------------------------
# Main Native SDK Component Instance
# -----------------------------------------------------------------------------

class MyComponent(Grasshopper.Kernel.GH_ScriptInstance):
    def __init__(self):
        super(MyComponent, self).__init__()
        # State tracking fields bound to this component across solves
        self.prev_record = False
        self.active = False
        self.sensor_dir = ""
        self.csv_path = ""
        self.meta_path = ""
        self.csv_file = None
        self.writer = None
        self.sample_count = 0
        self.last_t_ns = 0
        self.last_pose6 = []
        self.last_recorded_t_ns = None
        self.last_error = ""
        self._annotated = False

    def _ensure_annotation(self):
        """Applies explicit nomenclature descriptions directly to component pins."""
        if self._annotated:
            return
        try:
            comp = self.Component
            comp.Name = "DP 03 MOCAP RB Plane Recorder"
            comp.NickName = "DP_MOCAPRec"
            comp.Description = "Independent timestamped OptiTrack rigid-body Plane recorder. Saves plane.csv."
            input_specs = [
                ("record", "Record", "Record bool from Episode Controller."),
                ("episode_dir", "EpisodeDir", "Episode folder path from Episode Controller."),
                ("rigid_body_name", "RBName", "Rigid body/folder name, e.g. trowel or robot_tcp."),
                ("mocap_packet", "Packet", "Optional dict/object containing plane/pose6 and optional t_ns."),
                ("rb_plane", "Plane", "Raw OptiTrack RB Plane."),
                ("t_ns", "Timestamp", "Optional int timestamp for raw plane. Empty = assign now."),
                ("enabled", "Enabled", "Enable this recorder."),
                ("unit_scale", "UnitScale", "Position scale. 0.001 for mm->m; 1.0 if already meters."),
                ("min_period_ms", "MinPeriod", "Optional throttle in ms. 0 = record every solve/sample."),
                ("reset", "Reset", "Momentary button. Reset this recorder state."),
            ]
            output_specs = [
                ("status", "Status", "Human-readable status."),
                ("sample_count", "Samples", "Samples saved in current/last episode."),
                ("sensor_dir", "SensorDir", "This rigid body folder path."),
                ("last_t_ns", "LastT", "Last saved timestamp."),
                ("pose6", "Pose6", "Last pose [x,y,z,roll,pitch,yaw]."),
            ]
            for i, spec in enumerate(input_specs):
                if i < comp.Params.Input.Count:
                    comp.Params.Input[i].Name = spec[0]
                    comp.Params.Input[i].NickName = spec[1]
                    comp.Params.Input[i].Description = spec[2]
            for i, spec in enumerate(output_specs):
                if i < comp.Params.Output.Count:
                    comp.Params.Output[i].Name = spec[0]
                    comp.Params.Output[i].NickName = spec[1]
                    comp.Params.Output[i].Description = spec[2]
            self._annotated = True
        except Exception:
            pass

    def open_recorder(self, episode_dir, sensor_name, unit_scale=1.0):
        self.close_recorder()
        self.sensor_dir = os.path.join(episode_dir, sensor_name + "_plane")
        os.makedirs(self.sensor_dir, exist_ok=True)
        self.csv_path = os.path.join(self.sensor_dir, "plane.csv")
        self.meta_path = os.path.join(self.sensor_dir, "sensor_meta.json")
        self.csv_file = open(self.csv_path, "w", newline="")
        fieldnames = [
            "seq", "t_ns", "wall_time_ns",
            "x", "y", "z", "roll", "pitch", "yaw",
            "origin_x", "origin_y", "origin_z",
            "xaxis_x", "xaxis_y", "xaxis_z",
            "yaxis_x", "yaxis_y", "yaxis_z",
            "zaxis_x", "zaxis_y", "zaxis_z",
        ]
        self.writer = csv.DictWriter(self.csv_file, fieldnames=fieldnames)
        self.writer.writeheader()
        self.sample_count = 0
        self.last_t_ns = 0
        self.last_pose6 = []
        self.last_recorded_t_ns = None
        self.last_error = ""
        self.active = True
        
        meta = {
            "sensor_name": sensor_name,
            "sensor_type": "mocap_rigid_body_plane",
            "unit_scale_for_pose_xyz": float(unit_scale),
            "pose_format": "x,y,z,roll,pitch,yaw; xyz scaled by unit_scale; rpy in radians; ZYX convention",
            "timestamp_column": "t_ns",
            "timestamp_convention": "time.perf_counter_ns(), int64 nanoseconds, monotonic in Rhino Python process",
            "started_wall_time_ns": int(time.time_ns()),
            "started_perf_counter_ns": int(time.perf_counter_ns()),
            "csv_file": "plane.csv",
            "note": "origin_* columns are raw Rhino/OptiTrack plane units; x,y,z are scaled by unit_scale."
        }
        with open(self.meta_path, "w") as f:
            json.dump(meta, f, indent=2)

    def close_recorder(self):
        if self.csv_file is not None:
            try:
                self.csv_file.flush()
                self.csv_file.close()
            except Exception:
                pass
        self.csv_file = None
        self.writer = None
        self.active = False
        if self.meta_path:
            try:
                if os.path.exists(self.meta_path):
                    with open(self.meta_path, "r") as f:
                        meta = json.load(f)
                else:
                    meta = {}
            except Exception:
                meta = {}
            meta.update({
                "stopped_wall_time_ns": int(time.time_ns()),
                "stopped_perf_counter_ns": int(time.perf_counter_ns()),
                "sample_count": int(self.sample_count),
                "last_t_ns": int(self.last_t_ns or 0),
                "last_pose6": self.last_pose6,
                "last_error": self.last_error
            })
            try:
                with open(self.meta_path, "w") as f:
                    json.dump(meta, f, indent=2)
            except Exception:
                pass

    def append_sample(self, plane, t_ns, unit_scale=1.0, min_period_ms=0.0, pose6_override=None):
        if not self.active or self.writer is None:
            return False
        if plane is None and pose6_override is None:
            return False
        t_ns = int(t_ns)
        if self.last_recorded_t_ns is not None and float(min_period_ms or 0.0) > 0.0:
            if (t_ns - self.last_recorded_t_ns) < int(float(min_period_ms) * 1e6):
                return False
        try:
            row = _plane_to_row(plane, unit_scale=unit_scale, pose6_override=pose6_override)
            if row is None:
                return False
            self.sample_count += 1
            row.update({
                "seq": int(self.sample_count),
                "t_ns": int(t_ns),
                "wall_time_ns": int(time.time_ns()),
            })
            self.writer.writerow(row)
            if self.sample_count % 10 == 0:
                self.csv_file.flush()
            self.last_t_ns = int(t_ns)
            self.last_recorded_t_ns = int(t_ns)
            self.last_pose6 = [row["x"], row["y"], row["z"], row["roll"], row["pitch"], row["yaw"]]
            return True
        except Exception:
            self.last_error = traceback.format_exc()
            return False

    def RunScript(self,
            record,
            episode_dir,
            rigid_body_name,
            mocap_packet,
            rb_plane,
            t_ns,
            enabled,
            unit_scale,
            min_period_ms,
            reset):
        # 1. Update UI names
        self._ensure_annotation()

        # 2. Sanitize and provide default conversions
        record = bool(record)
        episode_dir = str(episode_dir or "").strip()
        rb_raw = str(rigid_body_name or "rigid_body").strip()
        clean_rb_name = "".join(ch if (ch.isalnum() or ch in ["_", "-", "."]) else "_" for ch in rb_raw) if rb_raw else "rigid_body"
        enabled = bool(enabled) if enabled is not None else True
        unit_scale = float(unit_scale) if unit_scale is not None else 1.0
        min_period_ms = float(min_period_ms) if min_period_ms is not None else 0.0
        reset = bool(reset)

        # 3. Handle Manual Resets
        if reset:
            self.close_recorder()
            self.prev_record = False
            self.sample_count = 0
            self.last_t_ns = 0
            self.last_pose6 = []
            self.last_recorded_t_ns = None
            self.last_error = ""
            return "State cleared manually.", 0, "", 0, []

        # 4. Extract Packet / Dictionary Variants Resiliently
        plane = None
        pose6_override = None
        pkt_t = None

        if mocap_packet is not None:
            if isinstance(mocap_packet, dict):
                for n in ["plane", "rb_plane", "mocap_plane"]:
                    if n in mocap_packet: plane = mocap_packet[n]; break
                for n in ["pose6", "pose", "robot_eef_pose"]:
                    if n in mocap_packet: pose6_override = mocap_packet[n]; break
                for n in ["t_ns", "timestamp_ns", "time_ns"]:
                    if n in mocap_packet: pkt_t = mocap_packet[n]; break
            else:
                for n in ["plane", "rb_plane", "mocap_plane"]:
                    if hasattr(mocap_packet, n): plane = getattr(mocap_packet, n); break
                for n in ["pose6", "pose", "robot_eef_pose"]:
                    if hasattr(mocap_packet, n): pose6_override = getattr(mocap_packet, n); break
                for n in ["t_ns", "timestamp_ns", "time_ns"]:
                    if hasattr(mocap_packet, n): pkt_t = getattr(mocap_packet, n); break

        if plane is None:
            plane = rb_plane
        if pkt_t is None:
            pkt_t = t_ns

        try:
            pkt_t = int(pkt_t) if pkt_t is not None and str(pkt_t) != "" else int(time.perf_counter_ns())
        except Exception:
            pkt_t = int(time.perf_counter_ns())

        # 5. Evaluate Hardware Timing Edges
        rising_edge = record and not self.prev_record
        falling_edge = (not record) and self.prev_record

        status = "Ready"
        if not enabled:
            status = "Disabled."
        else:
            if rising_edge:
                if episode_dir:
                    self.open_recorder(episode_dir, clean_rb_name, unit_scale=unit_scale)
                    status = f"Started {clean_rb_name}"
                else:
                    status = "Cannot start: episode_dir is empty."
            elif falling_edge:
                self.close_recorder()
                status = f"Stopped {clean_rb_name}. Saved {self.sample_count} samples."
            elif record and self.active:
                accepted = self.append_sample(plane, pkt_t, unit_scale=unit_scale, min_period_ms=min_period_ms, pose6_override=pose6_override)
                status = f"Recording {clean_rb_name} | samples={self.sample_count}{'' if accepted else ' | no new plane'}"
            elif record and not self.active:
                if episode_dir:
                    self.open_recorder(episode_dir, clean_rb_name, unit_scale=unit_scale)
                    status = f"Late-started {clean_rb_name}"
                else:
                    status = "Waiting for episode_dir."
            else:
                status = f"Ready: {clean_rb_name}"

        self.prev_record = record

        if self.last_error:
            status = status + " | ERROR: " + self.last_error[-200:]

        # Returns top-to-bottom mappings for output pins: status, sample_count, sensor_dir, last_t_ns, pose6
        return status, int(self.sample_count), self.sensor_dir, int(self.last_t_ns or 0), self.last_pose6
# ---------- end py3_3 ----------

py3_4 = Python3Script(enabled=Toggle(False), align_depth=Toggle(False), show_viewport=Toggle(False), reset=Button())  # -> out, a
# ---------- py3_4: Python ----------
"""
Grasshopper Python 3 component: RealSense Decoupled Streamer (SDK Class Mode)
==========================================================================
Purpose
-------
Streams color and depth frames from an Intel RealSense camera, separating them into 
independent packets (image_pkt and aligned_depth_pkt) sharing identical t_ns tracking
markers for direct pairing with independent downstream MOCAP recorders.
"""

import System
import Rhino
import Grasshopper
import time
import traceback
import ctypes

# Safely catch environment availability for pyrealsense2 and numpy
try:
    import pyrealsense2 as rs
    import numpy as np
except ImportError:
    rs = None
    np = None


# --- Viewport HUD Overlay Conduit ---
class LiveFeedConduit(Rhino.Display.DisplayConduit):
    def __init__(self):
        super().__init__()
        self.disp_bmp = None
        
    def update_image(self, sys_bitmap):
        if self.disp_bmp:
            self.disp_bmp.Dispose()
        self.disp_bmp = Rhino.Display.DisplayBitmap(sys_bitmap)
        
    def DrawForeground(self, e):
        if self.disp_bmp:
            e.Display.DrawBitmap(self.disp_bmp, 10, 10)
            
    def Clear(self):
        if self.disp_bmp:
            self.disp_bmp.Dispose()
            self.disp_bmp = None


class MyComponent(Grasshopper.Kernel.GH_ScriptInstance):
    def __init__(self):
        super(MyComponent, self).__init__()
        self.pipeline = None
        self.config = None
        self.profile = None
        self.align = None
        self.conduit = None
        self.is_running = False
        self._annotated = False
        self.last_error = ""

    def _ensure_annotation(self):
        """Applies explicit nomenclature descriptions directly to component pins."""
        if self._annotated:
            return
        try:
            comp = self.Component
            comp.Name = "RealSense Decoupled Stream"
            comp.NickName = "RS_DecoupledStream"
            comp.Description = "Streams Intel RealSense frames as completely independent color and depth packets."
            
            input_specs = [
                ("enabled", "Enabled", "Toggle camera pipeline active state."),
                ("align_depth", "AlignDepth", "True = Process and output aligned depth frame packet; False = Bypass depth entirely."),
                ("show_viewport", "ShowViewport", "Toggle on/off viewport preview generation to reduce computation load."),
                ("reset", "Reset", "Momentary button. Force restart/clear camera pipeline state."),
            ]
            output_specs = [
                ("status", "Status", "Human-readable camera state information."),
                ("image_pkt", "ImagePkt", "Bundled dictionary containing color_img and matching t_ns."),
                ("aligned_depth_pkt", "DepthPkt", "Bundled dictionary containing depth_img and matching t_ns (Null if AlignDepth=False)."),
            ]
            
            for i, spec in enumerate(input_specs):
                if i < comp.Params.Input.Count:
                    comp.Params.Input[i].Name = spec[0]
                    comp.Params.Input[i].NickName = spec[1]
                    comp.Params.Input[i].Description = spec[2]
            for i, spec in enumerate(output_specs):
                if i < comp.Params.Output.Count:
                    comp.Params.Output[i].Name = spec[0]
                    comp.Params.Output[i].NickName = spec[1]
                    comp.Params.Output[i].Description = spec[2]
            self._annotated = True
        except Exception:
            pass

    def start_pipeline(self, align_depth=True):
        if rs is None or np is None:
            raise ImportError("pyrealsense2 or numpy libraries are missing in this environment.")
        
        self.stop_pipeline()
        self.pipeline = rs.pipeline()
        self.config = rs.config()
        
        self.config.enable_stream(rs.stream.color, 640, 480, rs.format.bgr8, 30)
        
        # Only allocate USB bandwidth for depth stream if explicitly requested
        if align_depth:
            self.config.enable_stream(rs.stream.depth, 640, 480, rs.format.z16, 30)
        
        self.profile = self.pipeline.start(self.config)
        
        if align_depth:
            self.align = rs.align(rs.stream.color)
        else:
            self.align = None
            
        self.is_running = True
        self.last_error = ""

    def stop_pipeline(self):
        if self.pipeline is not None and self.is_running:
            try:
                self.pipeline.stop()
            except Exception:
                pass
        self.pipeline = None
        self.config = None
        self.profile = None
        self.align = None
        self.is_running = False

        if self.conduit is not None:
            try:
                self.conduit.Enabled = False
                self.conduit.Clear()
            except Exception:
                pass
        self.conduit = None

    def create_bitmap_from_bgr(self, bgr_array):
        try:
            h, w, ch = bgr_array.shape
            bmp = System.Drawing.Bitmap(w, h, System.Drawing.Imaging.PixelFormat.Format24bppRgb)
            bounds = System.Drawing.Rectangle(0, 0, w, h)
            bmp_data = bmp.LockBits(bounds, System.Drawing.Imaging.ImageLockMode.WriteOnly, bmp.PixelFormat)
            
            contiguous = np.ascontiguousarray(bgr_array)
            ptr = bmp_data.Scan0
            num_bytes = h * w * ch
            
            ctypes.memmove(int(ptr), contiguous.ctypes.data, num_bytes)
            bmp.UnlockBits(bmp_data)
            return bmp
        except Exception:
            return None

    def RunScript(self, enabled, align_depth, show_viewport, reset):
        # 1. Update UI annotations dynamically
        self._ensure_annotation()

        if rs is None or np is None:
            return "Missing Requirements (pyrealsense2 / numpy)", None, None

        enabled = bool(enabled)
        align_depth = bool(align_depth)
        show_viewport = bool(show_viewport)
        reset = bool(reset)

        if reset:
            self.stop_pipeline()
            Rhino.RhinoDoc.ActiveDoc.Views.Redraw()
            return "Pipeline cleared manually.", None, None

        if not enabled:
            if self.is_running:
                self.stop_pipeline()
                Rhino.RhinoDoc.ActiveDoc.Views.Redraw()
            return "Disabled.", None, None

        # 2. Lazy restart logic if alignment properties are changed on the fly
        if self.is_running and align_depth and self.align is None:
            self.stop_pipeline()  # Force re-configuration to activate depth hardware
        elif self.is_running and not align_depth and self.align is not None:
            self.stop_pipeline()  # Force re-configuration to drop depth processing overhead

        if not self.is_running:
            try:
                self.start_pipeline(align_depth)
            except Exception as e:
                self.last_error = traceback.format_exc()
                return f"Initialization Error: {str(e)}", None, None

        # 3. Toggle HUD infrastructure
        if show_viewport and self.conduit is None:
            self.conduit = LiveFeedConduit()
            self.conduit.Enabled = True
        elif not show_viewport and self.conduit is not None:
            self.conduit.Enabled = False
            self.conduit.Clear()
            self.conduit = None

        # 4. Process streaming frames
        try:
            frames = self.pipeline.wait_for_frames(timeout_ms=40)
            
            # ATOMIC TIMESTAMP GENERATION (Identical clock used by your MOCAP recorders)
            t_ns = time.perf_counter_ns()

            if self.align is not None:
                frames = self.align.process(frames)

            color_frame = frames.get_color_frame()
            depth_frame = frames.get_depth_frame() if align_depth else None

            if not color_frame:
                return "Active | Frame drop warning: empty color space", None, None

            # Unpack color stream array
            color_image = np.asanyarray(color_frame.get_data())

            # BUNDLE 1: Pure Color Packet
            image_pkt = {
                "color_img": color_image,
                "t_ns": int(t_ns),
                "width": int(color_frame.get_width()),
                "height": int(color_frame.get_height())
            }

            # BUNDLE 2: Optional Depth Packet
            aligned_depth_pkt = None
            if align_depth and depth_frame:
                depth_image = np.asanyarray(depth_frame.get_data())
                aligned_depth_pkt = {
                    "depth_img": depth_image,
                    "t_ns": int(t_ns),
                    "width": int(depth_frame.get_width()),
                    "height": int(depth_frame.get_height())
                }

            # Handle Viewport rendering safely if enabled
            if show_viewport:
                preview_bitmap = self.create_bitmap_from_bgr(color_image)
                if preview_bitmap and self.conduit:
                    self.conduit.update_image(preview_bitmap)
                    Rhino.RhinoDoc.ActiveDoc.Views.Redraw()
                if preview_bitmap:
                    preview_bitmap.Dispose() # Clear raw canvas footprint safely

            status = f"Streaming | t_ns={t_ns} | DepthActive={align_depth} | ViewportHUD={show_viewport}"
            return status, image_pkt, aligned_depth_pkt

        except Exception as e:
            status = f"Streaming | Processing anomaly: {str(e)}"
            return status, None, None

    def __del__(self):
        self.stop_pipeline()
# ---------- end py3_4 ----------
panel_8 = Panel(py3_4.a)
item_5 = ListItem(List=py3_4.a, Index=Slider(1, range=0..1), Wrap=True)
panel_9 = Panel(py3_3.a)
py3_5 = Python3Script(record=toggle_2, episode_dir=episode_dir, sensor_name="camera_1", image_packet=item_5, enabled=toggle, reset=Button())  # -> out, a
# ---------- py3_5: Python ----------
"""
Grasshopper Python 3 component: DP 01 Image Packet Recorder (SDK Class Mode)
============================================================================
Purpose
-------
Asynchronous independent packet recorder. Consumes image packets from the 
RealSense streamer and saves them to disk matching the exact t_ns timestamp 
convention used by the MOCAP recorder.
"""

import os
import csv
import time
import json
import queue
import threading
import traceback
import Grasshopper

# Try importing optimization extensions safely
try:
    import numpy as np
except ImportError:
    np = None


def _safe_name(text, fallback="camera_sensor"):
    text = str(text or "").strip() or fallback
    return "".join(ch if (ch.isalnum() or ch in ["_", "-", "."]) else "_" for ch in text)


def _shape_of_image(arr):
    try:
        shape = arr.shape
        if len(shape) == 2:
            return int(shape[1]), int(shape[0]), 1
        if len(shape) == 3:
            return int(shape[1]), int(shape[0]), int(shape[2])
    except Exception:
        pass
    return 0, 0, 0


def _save_packet_image(path, arr, image_format="jpg", jpeg_quality=90):
    """Saves raw NumPy matrix to disk via OpenCV using high-speed pipeline configurations."""
    fmt = (image_format or "jpg").lower().strip().replace("jpeg", "jpg")
    
    try:
        import cv2
        # Determine if dealing with 16-bit depth maps vs 8-bit color maps
        is_depth = (arr.dtype == np.uint16 or len(arr.shape) == 2)
        
        if is_depth:
            # Force lossless compressions for depth spaces
            out_path = os.path.splitext(path)[0] + ".png"
            cv2.imwrite(out_path, arr)
            return out_path
            
        # Color mapping stream saving pipeline
        if fmt == "jpg":
            cv2.imwrite(path, arr, [int(cv2.IMWRITE_JPEG_QUALITY), int(jpeg_quality)])
        else:
            cv2.imwrite(path, arr)
        return path
    except Exception:
        # Fallback to standard raw numpy binary write if OpenCV is unavailable (Absolute fastest possible write)
        npy_path = os.path.splitext(path)[0] + ".npy"
        np.save(npy_path, arr)
        return npy_path


class MyComponent(Grasshopper.Kernel.GH_ScriptInstance):
    def __init__(self):
        super(MyComponent, self).__init__()
        # Sticky state equivalents localized exclusively to this component instance instance
        self.sensor_name = ""
        self.prev_record = False
        self.active = False
        self.sensor_dir = ""
        self.frames_dir = ""
        self.csv_path = ""
        self.meta_path = ""
        self.q = None
        self.thread = None
        self.stop_token = object()
        
        self.frame_count = 0
        self.dropped_count = 0
        self.last_t_ns = 0
        self.last_filename = ""
        self.last_seen_t_ns = None
        self.last_recorded_t_ns = None
        self.last_error = ""
        
        self._annotated = False

    def _ensure_annotation(self):
        if self._annotated:
            return
        try:
            comp = self.Component
            comp.Name = "DP 01 Packet Image Recorder"
            comp.NickName = "DP_PktImgRec"
            comp.Description = "Asynchronously dumps camera packets matching timestamps to offline MOCAP frames."
            
            input_specs = [
                ("record", "Record", "Record sequence command tracker from Episode Controller."),
                ("episode_dir", "EpisodeDir", "Path location mapped for runtime targets."),
                ("sensor_name", "SensorName", "Desired directory base string container name (e.g., color_cam)."),
                ("image_packet", "Packet", "The dictionary stream output from the RealSense provider component."),
                ("enabled", "Enabled", "Toggle active listener execution logic status."),
                ("image_format", "Format", "jpg or png format selector parameters."),
                ("jpeg_quality", "Quality", "Compression resolution parameter definitions (1-100)."),
                ("min_period_ms", "MinPeriod", "Optional throttle in ms. 0 = save everything."),
                ("reset", "Reset", "Wipes active internal state arrays clean."),
            ]
            output_specs = [
                ("status", "Status", "Detailed operational execution tracing diagnostic statements."),
                ("frame_count", "Frames", "Total accepted disk matrix entries within active episode loops."),
                ("dropped_count", "Dropped", "Queue collision drop warnings counts."),
                ("sensor_dir", "SensorDir", "Target base storage folder location properties."),
                ("last_t_ns", "LastT", "The final timestamp successfully written to the runtime tracker log."),
            ]
            for i, spec in enumerate(input_specs):
                if i < comp.Params.Input.Count:
                    comp.Params.Input[i].Name = spec[0]
                    comp.Params.Input[i].NickName = spec[1]
                    comp.Params.Input[i].Description = spec[2]
            for i, spec in enumerate(output_specs):
                if i < comp.Params.Output.Count:
                    comp.Params.Output[i].Name = spec[0]
                    comp.Params.Output[i].NickName = spec[1]
                    comp.Params.Output[i].Description = spec[2]
            self._annotated = True
        except Exception:
            pass

    def open_session(self, episode_dir, sensor_name, image_format, jpeg_quality):
        self.close_session()
        self.sensor_name = _safe_name(sensor_name, "camera_image")
        self.sensor_dir = os.path.join(episode_dir, self.sensor_name)
        self.frames_dir = os.path.join(self.sensor_dir, "frames")
        os.makedirs(self.frames_dir, exist_ok=True)
        
        self.csv_path = os.path.join(self.sensor_dir, "timestamps.csv")
        self.meta_path = os.path.join(self.sensor_dir, "sensor_meta.json")
        
        # Instantiate thread buffer queue (max capacity 128 frames prevents RAM starvation)
        self.q = queue.Queue(maxsize=128)
        self.frame_count = 0
        self.dropped_count = 0
        self.last_t_ns = 0
        self.last_filename = ""
        self.last_seen_t_ns = None
        self.last_recorded_t_ns = None
        self.last_error = ""
        
        self.active = True
        self.thread = threading.Thread(target=self._writer_loop, args=(image_format, jpeg_quality), daemon=True)
        self.thread.start()

        meta = {
            "sensor_name": self.sensor_name,
            "sensor_type": "packetized_realsense_matrix",
            "timestamp_convention": "time.perf_counter_ns() int64 assigned at camera ingestion hook",
            "started_wall_time_ns": int(time.time_ns()),
            "started_perf_counter_ns": int(time.perf_counter_ns())
        }
        with open(self.meta_path, "w") as f:
            json.dump(meta, f, indent=2)

    def close_session(self):
        if self.active and self.q is not None:
            try:
                self.q.put(self.stop_token, timeout=1.0)
            except Exception:
                pass
            try:
                if self.thread is not None:
                    self.thread.join(timeout=2.0)
            except Exception:
                pass
        self.active = False
        self.q = None
        self.thread = None
        
        if self.meta_path and os.path.exists(os.path.dirname(self.meta_path)):
            try:
                with open(self.meta_path, "r") as f:
                    meta = json.load(f)
            except Exception:
                meta = {}
            meta.update({
                "stopped_wall_time_ns": int(time.time_ns()),
                "stopped_perf_counter_ns": int(time.perf_counter_ns()),
                "frame_count": int(self.frame_count),
                "dropped_count": int(self.dropped_count),
                "last_t_ns": int(self.last_t_ns),
                "last_error": self.last_error
            })
            try:
                with open(self.meta_path, "w") as f:
                    json.dump(meta, f, indent=2)
            except Exception:
                pass

    def enqueue_packet(self, image_packet, min_period_ms=0.0):
        if not self.active or self.q is None or not isinstance(image_packet, dict):
            return False
            
        # Dynamically switch extract key depending on color vs depth payload inside dictionary
        img = image_packet.get("color_img") if "color_img" in image_packet else image_packet.get("depth_img")
        t_ns = image_packet.get("t_ns")
        
        if img is None or t_ns is None:
            return False
            
        t_ns = int(t_ns)
        if self.last_seen_t_ns == t_ns:
            return False
        self.last_seen_t_ns = t_ns

        # Optional frame throttle check
        if self.last_recorded_t_ns is not None and float(min_period_ms or 0.0) > 0.0:
            if (t_ns - self.last_recorded_t_ns) < int(float(min_period_ms) * 1e6):
                return False

        seq = self.frame_count + self.dropped_count + 1
        ext = "png" if "depth_img" in image_packet else "jpg"
        filename = f"frame_{seq:06d}.{ext}"
        w, h, ch = _shape_of_image(img)
        
        item = {
            "seq": seq,
            "t_ns": t_ns,
            "wall_time_ns": int(time.time_ns()),
            "filename": filename,
            "width": w,
            "height": h,
            "channels": ch,
            "image": img,
        }
        
        try:
            # Drop cleanly and immediately if the consumer thread falls too far behind
            self.q.put_nowait(item)
            self.last_recorded_t_ns = t_ns
            return True
        except queue.Full:
            self.dropped_count += 1
            return False

    def _writer_loop(self, image_format, jpeg_quality):
        try:
            with open(self.csv_path, "w", newline="") as f:
                writer = csv.DictWriter(f, fieldnames=["seq", "t_ns", "wall_time_ns", "filename", "width", "height", "channels"])
                writer.writeheader()
                
                while True:
                    item = self.q.get()
                    if item is self.stop_token:
                        break
                    try:
                        img_matrix = item.pop("image")
                        target_path = os.path.join(self.frames_dir, item["filename"])
                        
                        # Execute thread execution write onto disk allocation space
                        actual_path = _save_packet_image(target_path, img_matrix, image_format, jpeg_quality)
                        item["filename"] = os.path.basename(actual_path)
                        
                        writer.writerow(item)
                        self.frame_count += 1
                        self.last_t_ns = int(item["t_ns"])
                        
                        # Periodically flush pipeline logs onto tracking sectors
                        if self.frame_count % 10 == 0:
                            f.flush()
                    except Exception as e:
                        self.last_error = str(e)
                f.flush()
        except Exception:
            self.last_error = traceback.format_exc()

    def RunScript(self,
            record,
            episode_dir,
            sensor_name,
            image_packet,
            enabled,
            image_format,
            jpeg_quality,
            min_period_ms,
            reset):
        self._ensure_annotation()

        if np is None:
            return "Missing Dependency: numpy module is required.", 0, 0, None, 0

        # Type adjustments
        record = bool(record)
        enabled = bool(enabled)
        reset = bool(reset)
        episode_dir = str(episode_dir or "").strip()
        sensor_name = str(sensor_name or "").strip()
        image_format = str(image_format or "jpg")
        jpeg_quality = int(jpeg_quality or 90)
        min_period_ms = float(min_period_ms or 0.0)

        if reset:
            self.close_session()
            self.prev_record = False
            return "Cleared state records.", 0, 0, "", 0

        if not enabled:
            if self.active:
                self.close_session()
            return "Disabled.", 0, 0, "", 0

        # Detect edge states via record trigger signals
        rising_edge = record and not self.prev_record
        falling_edge = (not record) and self.prev_record

        if rising_edge:
            if episode_dir:
                self.open_session(episode_dir, sensor_name, image_format, jpeg_quality)
                status_msg = f"Started logging session: {sensor_name}"
            else:
                status_msg = "Error: Input episode_dir path was empty."
        elif falling_edge:
            self.close_session()
            status_msg = f"Stopped. Saved {self.frame_count} matrix frames successfully."
        elif record and self.active:
            accepted = self.enqueue_packet(image_packet, min_period_ms)
            status_msg = f"Recording {self.sensor_name} | Buffered Frames={self.frame_count} | Dropped={self.dropped_count}"
            if not accepted and isinstance(image_packet, dict):
                status_msg += " | Frame skipping / throttling active"
        elif record and not self.active:
            if episode_dir:
                self.open_session(episode_dir, sensor_name, image_format, jpeg_quality)
                status_msg = f"Late-start tracking hooked: {sensor_name}"
            else:
                status_msg = "Waiting on controller directory generation..."
        else:
            status_msg = f"Ready listener: {sensor_name if sensor_name else 'Unconfigured'}"

        self.prev_record = record

        if self.last_error:
            status_msg += f" | Last Thread Anomaly: {self.last_error[-80:]}"

        return status_msg, int(self.frame_count), int(self.dropped_count), self.sensor_dir, int(self.last_t_ns)

    def __del__(self):
        """Emergency cleanup handler if deleted or recompiled inside Grasshopper canvas definitions."""
        self.close_session()
# ---------- end py3_5 ----------
